# Dynamo graph script.dyn "Create_FinishFlrsFromSelectedRooms" (Dynamo 2.16.1.2727)
# packages: Data-Shapes 2022.2.103, Clockwork for Dynamo 2.x 2.4.0, WombatDynamo 2.3.5, spring nodes 210.1.1

# group: WIP
# note: "Work in Progress"

# group: Design
# note: For List Management \ Back-End Functionality

# group: Annotation
# note: For Comments

# group: Info
# note: Good to know stuff

# group: Annotation
# note: For notes and titles

# group: Change / Output
# note: For changes made to Revit or Other App

# group: Control
# note: For sliders and other options

# group: User Input
# note: For selection and whatnot

# group: Background
# note: For workflow

# group: REQUIRED PACKAGES
# note: Data-Shapes | v.2022.2.103
# Clockwork | v2.4.0
# WombatDynamo | v.2.3.5
# spring nodes | v.210.1.1

# group: REVIT PROJECT REPORT
# note: CREATED BY: Ren Rainville
# CREATED: 09/2019
# VERSION <1.5>
# LAST EDITED: 03/10/2023
# DYNAMO VERSION: <Dynamo 2.16>
# NOTES:
# This tool allows a user to select specific rooms in the active view and create a finish floor (of selected type) based on the room boundary curve elements.

# group: Select Rooms (from Active View) and Pick Floor type
code_block = CodeBlock { "Rooms in Active View and Floor Type to Create"; }
file_path = Filename("F:\Operations\Marketing\Brand Materials\Logos\GGLO_logo_black.png")
code_block_2 = CodeBlock { "Engage"; "ABORT!"; }
code_block_3 = CodeBlock()
# ---------- code_block_3.designscript (2 lines) ----------
"Tool Tip";
"This Tool allows a user to open a model fil in the background, detached from Central, and select Elements of CATEGORY to copy into the current model file.";
# ----------------------------------------
# note: Custom Node: Data-Shapesv.2022.2.103
ui_textnote_data = Custom[UI.TextNote Data](Title=code_block_3.out0, TextNote=code_block_3.out1)  # package Data-Shapes; Create Data for TextNote input in UI.MultipleInputForm ++ . Check out www.data-shapes.net for more informations
code_block_4 = CodeBlock { "Select Rooms to Create Finish Floors within"; "Select Rooms"; }
code_block_5 = CodeBlock { "Rooms"; }
byName = Category.ByName(name=code_block_5)
ui_selectmodelelements_data = Custom[UI.SelectModelElements Data](InputName=code_block_4.out0, ButtonText=code_block_4.out1, CategoryFilter=byName)  # package Data-Shapes; Creates a Revit element selection input for UI.MultipleInputForm++ . Check out www.data-shapes.net for more infos!
code_block_6 = CodeBlock { "Select Floor Type to Create"; }
code_block_7 = CodeBlock { "FloorType"; }
# note: Custom Node: Clockwork
byName_2 = Custom[ElementType.ByName](name=code_block_7)  # package Clockwork for Dynamo 2.x; Retrieves an element type by its name - to be used with the OOTB node "All Elements of Type".
all_elements_of_type = ElementsOfType(element_type=byName_2)
name = Element.Name(element=all_elements_of_type)
ui_dropdown_data = Custom[UI.DropDown Data](InputName=code_block_6, Keys=name, Values=all_elements_of_type)  # package Data-Shapes; Create data for DropDown input in UI.MultiInputForm ++ . Check out www.data-shapes.net for more infos.
list_create = List.Create(item0=ui_textnote_data, item1=ui_selectmodelelements_data, item2=ui_dropdown_data)
boolean = BoolSelector(true)
code_block_8 = CodeBlock { "https://go.gglo.com/Production/SitePages/Dynamo.aspx"; }
ui_multipleinputform = Custom[UI.MultipleInputForm ++](Description_optional=code_block, Logo_optional=file_path, ButtonText_optional=code_block_2.out0, Inputs=list_create, Toggle=boolean, LinkToHelp_optional=code_block_8, CancelButtonText_optional=code_block_2.out1)  # package Data-Shapes; Create a form with multiple inputs. see www.data-shapes.net for tutorials and infos!
rooms_x_0_floor_type_x_1 = CodeBlock(x=ui_multipleinputform.User_Inputs) { x[0]; x[1]; }

# group: Get Active View (Level & Plane)
boolean_2 = BoolSelector(true)
# note: Custom Node: spring nodesv.210.1.1
ꟿ_document_activeview = Custom[ꟿ Document.ActiveView](refresh=boolean_2)  # package spring nodes; Selects the current document's active view. Supports more view types than the built-in option. Will be depreciated once the bult in node works with all plan types.
# note: Custom Node: Clockwork
level = Custom[Element.Level](element=ꟿ_document_activeview)  # package Clockwork for Dynamo 2.x; Gets an element's level
plane = Custom[Level.Plane](level=level)  # package Clockwork for Dynamo 2.x; Retrieves the plane of a given level

# group: Get Room Boundaries
# note: Custom Node: Clockwork
boundaries = Custom[Room.Boundaries](room=rooms_x_0_floor_type_x_1.out0)  # package Clockwork for Dynamo 2.x; Gets a list of all boundaries of a given room or area and a corresponding list of the elements that are generating those boundaries.
pullOntoPlane = Curve.PullOntoPlane(curve=boundaries.curves@L2, plane=plane)

# group: Create Floors and Elevate by Thickness
byOutlineTypeAndLevel = Floor.ByOutlineTypeAndLevel(outlineCurves=pullOntoPlane, floorType=rooms_x_0_floor_type_x_1.out1, level=level)
code_block_9 = CodeBlock { "Height Offset From Level"; }
count = List.Count(list=byOutlineTypeAndLevel)
ofRepeatedItem = List.OfRepeatedItem(item=code_block_9, amount=count)
code_block_10 = CodeBlock { "Thickness"; }
getParameterValueByName = Element.GetParameterValueByName(element=byOutlineTypeAndLevel, parameterName=code_block_10)
# note: Custom Node: WombatDynamov.2.3.5
setParameterValuesByNames = WombatDynamo.Element.SetParameterValuesByNames(element=byOutlineTypeAndLevel, parameterNames=ofRepeatedItem, values=getParameterValueByName)

code_block_11 = CodeBlock(X=rooms_x_0_floor_type_x_1.out0) { X; }
code_block_12 = CodeBlock(X=rooms_x_0_floor_type_x_1.out1) { X; }
