# Dynamo graph script.dyn "Create_CurtainWallGrids-HorizPerLevels" (Dynamo 2.16.1.2727)
# packages: Rhythm 2023.2.2, Data-Shapes 2022.2.103, Clockwork for Dynamo 2.x 2.4.0, Genius Loci 2023.1.23, WombatDynamo 2.3.5

# group: WIP
# note: "Work in Progress"

# group: Design
# note: For List Management \ Back-End Functionality

# group: Annotation
# note: For Comments

# group: Info
# note: Good to know stuff

# group: Annotation
# note: For notes and titles

# group: Change / Output
# note: For changes made to Revit or Other App

# group: Control
# note: For sliders and other options

# group: User Input
# note: For selection and whatnot

# group: Background
# note: For workflow

# group: REQUIRED PACKAGES
# note: Rhythm | v.2023.2.2
# Data-Shapes | v.2022.2.103
# Clockwork | v2.4.0
# GeniusLoci | v.2023.1.23
# WombatDynamo | v.2.3.5

# group: REVIT PROJECT REPORT
# note: CREATED BY: Ren Rainville
# CREATED: 11/2019
# VERSION <1.0>
# LAST EDITED: 03/10/2023
# DYNAMO VERSION: <Dynamo 2.16>
# NOTES:
# This tool is designed to create curtain wall grids at all levels (with keyword or prefix provided by user) above the Selected Curtain Wall's base constraint.

# group: MultipleInputFormUI++ (Asks User for Input Data to Run)
code_block = CodeBlock { "Sorting Levels for Alignment"; }
file_path = Filename("H:\Dynamo\General\GGLO_logo_black.png")
code_block_2 = CodeBlock { "Engage"; "ABORT!"; }
code_block_3 = CodeBlock { "Enter Level Keyword or Prefix: ('LEVEL' or Bldg Number or Letter)"; "Keyword / Prefix"; false; }
# note: Custom Node: Data-Shapesv.2022.2.103
ui_textbox_data = Custom[UI.TextBox Data](InputName=code_block_3.out0, DefaultText=code_block_3.out1, IsNumberEntry=code_block_3.out2)  # package Data-Shapes; Create Data for TextBox input in UI.MultipleInputForm ++ . Check out www.data-shapes.net for more informations
code_block_4 = CodeBlock { "Select if the Text is a Keyword or Prefix:"; ["Keyword","Prefix"]; [0,1]; }
ui_dropdown_data = Custom[UI.DropDown Data](InputName=code_block_4.out0, Keys=code_block_4.out1, Values=code_block_4.out2)  # package Data-Shapes; Create data for DropDown input in UI.MultiInputForm ++ . Check out www.data-shapes.net for more infos.
code_block_5 = CodeBlock { "Select Project Units (Imperial / Metric):"; ["Imperial","Metric"]; [0,1]; }
ui_dropdown_data_2 = Custom[UI.DropDown Data](InputName=code_block_5.out0, Keys=code_block_5.out1, Values=code_block_5.out2)
code_block_6 = CodeBlock { "Select the Curtain Wall Element to Create Horizontal Grids at Levels:"; "Select Curtain Wall"; }
code_block_7 = CodeBlock { "Walls"; }
byName = Category.ByName(name=code_block_7)
code_block_8 = CodeBlock { true; }
ui_selectmodelelements_data = Custom[UI.SelectModelElements Data](InputName=code_block_6.out0, ButtonText=code_block_6.out1, CategoryFilter=byName, SelectSingleElement=code_block_8)  # package Data-Shapes; Creates a Revit element selection input for UI.MultipleInputForm++ . Check out www.data-shapes.net for more infos!
list_create = List.Create(item0=ui_textbox_data, item1=ui_dropdown_data, item2=ui_dropdown_data_2, item3=ui_selectmodelelements_data)
boolean = BoolSelector(true)
code_block_9 = CodeBlock { "https://go.gglo.com/Production/SitePages/Dynamo.aspx"; }
ui_multipleinputform = Custom[UI.MultipleInputForm ++](Description_optional=code_block, Logo_optional=file_path, ButtonText_optional=code_block_2.out0, Inputs=list_create, Toggle=boolean, LinkToHelp_optional=code_block_9, CancelButtonText_optional=code_block_2.out1)  # package Data-Shapes; Create a form with multiple inputs. see www.data-shapes.net for tutorials and infos!
code_block_10 = CodeBlock(x=ui_multipleinputform.User_Inputs) { x[0]; x[1]; x[2]; x[3]; }

code_block_11 = CodeBlock(x=code_block_10.out3) { x; }

# group: Get CurtainGrid
# note: Custom Node: Rhythmv.2023.2.2
ʳʰʸᵗʰᵐ_curtaingrid_bywallelement = Rhythm.Revit.Elements.CurtainGrid.ByWallElement(curtainWall=code_block_11)

# group: FYI, Confirmation during Testing
getLocation = Element.GetLocation(element=code_block_11)
startPoint = Curve.StartPoint(curve=getLocation)

# group: Collect All Levels in Project
code_block_12 = CodeBlock { "Levels"; }
byName_2 = Category.ByName(name=code_block_12)
all_elements_of_category = ElementsOfCategory(Category=byName_2)

code_block_13 = CodeBlock { ","; }
split = String.Split(string=code_block_10.out0, separator0=code_block_13)

# group: Test if Name String Contains or Starts with the User Input Keyword or Prefix
name = Element.Name(element=all_elements_of_category)
contains = String.Contains(string=name, searchFor=split@L1)
startsWith = String.StartsWith(string=name, searchFor=split@L1)
list_create_2 = List.Create(item0=contains, item1=startsWith)
getItemAtIndex = List.GetItemAtIndex(list=list_create_2, index=code_block_10.out1)

filterByBoolMask = List.FilterByBoolMask(list=all_elements_of_category, mask=getItemAtIndex@L2)

# group: Sort Levels by Elevation
flatten = List.Flatten(list=filterByBoolMask.in)
elevation = Level.Elevation(level=flatten)
sortByKey = List.SortByKey(list=flatten, keys=elevation)

# group: Get Base Constraint of Selection
code_block_14 = CodeBlock { "Base Constraint"; }
getParameterValueByName = Element.GetParameterValueByName(element=code_block_11, parameterName=code_block_14)

# group: Select Levels above Base Constraint of Selected Curtain Wall
# note: Custom Node: Clockwork
plane = Custom[Level.Plane](level=sortByKey.sortedList)  # package Clockwork for Dynamo 2.x; Retrieves the plane of a given level
# note: Custom Node: WombatDynamov.2.3.5
deconstruct = WombatDynamo.Plane.Deconstruct(plane=plane)
id = Element.Id(element=getParameterValueByName)
code_block_15 = CodeBlock(x=sortByKey.sortedList) { x; }
id_2 = Element.Id(element=code_block_15)
eq = id == id_2
code_block_16 = CodeBlock { true; }
firstIndexOf = List.FirstIndexOf(list=eq, item=code_block_16)
code_block_17 = CodeBlock(x=firstIndexOf) { x+1; }
dropItems = List.DropItems(list=deconstruct.O, amount=code_block_17)
deconstruct_2 = WombatDynamo.Point.Deconstruct(point=dropItems)

# group: Pick Imperial or Metric Values Per User Input
convert_by_units = DynamoUnitConvert(deconstruct_2.Z, MeasurementType="autodesk.unit.quantity:length-1.0.4", FromConversion="autodesk.unit.unit:millimeters-1.0.1", ToConversion="autodesk.unit.unit:feet-1.0.1")
if_ = RefactoredIf(test=code_block_10.out2, true=convert_by_units, false=deconstruct_2.Z)

# group: Determine PBP Elevation
# note: Custom Node: GeniusLociv.2023.1.23
get_project_locations = Custom[Get Project Locations]()  # package Genius Loci; Works only in Revit 2018 and later. Retrieves the project positions of the given document in the Survey Coordinate System. (Coordinates of Internal origin, project base point and survey point)
code_block_18 = CodeBlock(x=get_project_locations.Project_Base_Point) { x[0]; }
# note: Custom Node: WombatDynamov.2.3.5
deconstruct_3 = WombatDynamo.Point.Deconstruct(point=code_block_18)

# group: Add PBP Elevation to Z Value of CurtainGridLine
# note: Custom Node: WombatDynamov.2.3.5
deconstruct_4 = WombatDynamo.Point.Deconstruct(point=startPoint)
code_block_19 = CodeBlock(x=deconstruct_4.Z, y=deconstruct_3.Z) { x+y; }
code_block_20 = CodeBlock { 1; }
round = Math.Round(number=code_block_19, digits=code_block_20)

code_block_21 = CodeBlock(x=deconstruct_4.Z) { x; }
code_block_22 = CodeBlock(x=if_, y=round, b=code_block_21) { x-y+b; }

# group: Create Points
byCoordinates = Point.ByCoordinates(x=deconstruct_4.X, y=deconstruct_4.Y, z=code_block_22)

# group: To Revit - Create Horizontal Grids at Levels above Base Constraint
code_block_23 = CodeBlock { true; }
# note: Custom Node: Rhythmv.2023.2.2
ʳʰʸᵗʰᵐ_curtaingrid = Rhythm.Revit.Elements.CurtainGrid.AddGridLineByPoint(curtainGrid=ʳʰʸᵗʰᵐ_curtaingrid_bywallelement.curtainGrid, locationPoint=byCoordinates, isUGridline=code_block_23)
