# Dynamo graph script.dyn "Place_IntElevAtSelectedRmsOfActiveView" (Dynamo 2.12.0.5650)
# packages: Rhythm 2021.4.2, spring nodes 210.1.1, Clockwork for Dynamo 2.x 2.3.0, Data-Shapes 2022.2.103, designtech 1.0.8, WombatDynamo 2.3.5

# group: WIP
# note: "Work in Progress"

# group: Design
# note: For List Management \ Back-End Functionality

# group: Annotation
# note: For Comments

# group: Info
# note: Good to know stuff

# group: Annotation
# note: For notes and titles

# group: Change / Output
# note: For changes made to Revit or Other App

# group: Control
# note: For sliders and other options

# group: User Input
# note: For selection and whatnot

# group: Background
# note: For workflow

# group: REQUIRED PACKAGES
# note: Rhythm |  v.2021.4.2
# spring nodes |  v.210.1.1
# Clockwork |  v.2.3.0
# Data-Shapes |  v.2022.2.103
# designtech |  v.1.0.8
# WombatDynamo |  v.2.3.5

# group: REVIT PROJECT REPORT
# note: CREATED BY: Ren Rainville
# CREATED: 08/2019
# VERSION <1.2>
# LAST EDITED: 04/26/2022
# DYNAMO VERSION: <Dynamo 2.12>
# NOTES:
# This tool will place interior elevations at the center of each selected room. (Update: Added feature to set far clip to half room width / height)

# group: User Selection of Rooms in Active View
code_block = CodeBlock { "Select Rooms to Create Interior Elevations at Center (Remember to Click Finish in Top Left)"; }
file_path = Filename("F:\Operations\Marketing\Brand Materials\Logo\GGLO_logo_black.png")
code_block_2 = CodeBlock { "Engage"; "ABORT!"; }
code_block_3 = CodeBlock()
# ---------- code_block_3.designscript (2 lines) ----------
"Tool Tip";
"This Tool allows a user to place interior elevations at the center of each selected room. (Update: Added feature to set far clip to half the room width / height).";
# ----------------------------------------
# note: Custom Node: Data-Shapes v.2022.2.103
ui_textnote_data = Custom[UI.TextNote Data](Title=code_block_3.out0, TextNote=code_block_3.out1)  # package Data-Shapes; Create Data for TextNote input in UI.MultipleInputForm ++ . Check out www.data-shapes.net for more informations
code_block_4 = CodeBlock { "Select Rooms in Active View"; }
code_block_5 = CodeBlock { "OST_Rooms"; }
byName = Category.ByName(name=code_block_5)
ui_selectmodelelements_data = Custom[UI.SelectModelElements Data](InputName=code_block_4, CategoryFilter=byName)  # package Data-Shapes; Creates a Revit element selection input for UI.MultipleInputForm++ . Check out www.data-shapes.net for more infos!
list_create = List.Create(item0=ui_textnote_data, item1=ui_selectmodelelements_data)
boolean = BoolSelector(true)
code_block_6 = CodeBlock { "https://go.gglo.com/Production/SitePages/Dynamo.aspx"; }
ui_multipleinputform = Custom[UI.MultipleInputForm ++](Description_optional=code_block, Logo_optional=file_path, ButtonText_optional=code_block_2.out0, Inputs=list_create, Toggle=boolean, LinkToHelp_optional=code_block_6, CancelButtonText_optional=code_block_2.out1)  # package Data-Shapes; Create a form with multiple inputs. see www.data-shapes.net for tutorials and infos!

# group: Get Room Center Point
geometry = Element.Geometry(element=ui_multipleinputform.User_Inputs)
centroid = Solid.Centroid(solid=geometry)
code_block_7 = CodeBlock(pt=centroid) { pt.X; pt.Y; }
byCoordinates = Point.ByCoordinates(x=code_block_7.out0, y=code_block_7.out1)

# group: Set Elev ViewFamilyType
code_block_8 = CodeBlock { "ViewFamilyType"; }
# note: Custom Node: Clockwork v.2.3.0
byName_2 = Custom[ElementType.ByName](name=code_block_8)  # package Clockwork for Dynamo 2.x; Retrieves an element type by its name - to be used with the OOTB node "All Elements of Type".
all_elements_of_type = ElementsOfType(element_type=byName_2)
name = Element.Name(element=all_elements_of_type)
code_block_9 = CodeBlock { "Interior Elevation"; }
eq = name == code_block_9
filterByBoolMask = List.FilterByBoolMask(list=all_elements_of_type, mask=eq)

# group: Refresh Toggle
boolean_2 = BoolSelector(true)  # graph input

# note: Custom Node: spring nodes v.210.1.1
activeView = Custom[Springs.Doc.ActiveView](refresh=boolean_2)  # package spring nodes; Selects the current document's active view. Supports more view types than the built-in option. Will be depreciated once the bult in node works with all plan types.

# group: Set Elevation Marker and which Elevations to Activate
code_block_10 = CodeBlock { 24; 48; 96; }
# note: Custom Node: Rhythm v.2021.4.2
createElevationMarker = Rhythm.Revit.Elements.ElevationMarker.CreateElevationMarker(location=byCoordinates, scaleFactor=code_block_10.out1, viewFamilyType=filterByBoolMask.in)
code_block_11 = CodeBlock { 0; 1..3..1; }
addItemToEnd = List.AddItemToEnd(item=code_block_11.out0, list=code_block_11.out1)
createElevationByMarkerIndex = Rhythm.Revit.Elements.ElevationMarker.CreateElevationByMarkerIndex(elevationMarker=createElevationMarker, planView=activeView, index=addItemToEnd)

# group: Create Names for Elevations from Room Names
count = List.Count(list=addItemToEnd)
code_block_12 = CodeBlock(x=count) { 1..x..1; }
code_block_13 = CodeBlock(x=code_block_12) { "_ELEV-"+x; "View Name"; }
# note: Custom Node: Clockwork v.2.3.0
name_2 = Custom[Element.Name+](element=ui_multipleinputform.User_Inputs@L2)  # package Clockwork for Dynamo 2.x; Gets an element's name. Unlike the OOTB node, this node should work for all Revit elements that have names and will also return the localized names of system parameters, parameter groups, display unit types, parameter types, unit symbol types and unit types.
ofRepeatedItem = List.OfRepeatedItem(item=name_2, amount=count)
transpose = List.Transpose(lists=ofRepeatedItem)
flatten = List.Flatten(list=code_block_13.out0)
count_2 = List.Count(list=transpose)
ofRepeatedItem_2 = List.OfRepeatedItem(item=flatten, amount=count_2)
code_block_14 = CodeBlock(x=transpose, y=ofRepeatedItem_2) { x+y; }
transpose_2 = List.Transpose(lists=code_block_14@L3)

ꟿ_list_getevenodd = Custom[ꟿ List.GetEvenOdd](list=createElevationByMarkerIndex@L2)  # package spring nodes; Gets the even and odd indices from the list.
list_create_2 = List.Create(item0=ꟿ_list_getevenodd.even, item1=ꟿ_list_getevenodd.odd)

# group: Get Room Size and Prep for Setting Far Clip to Half Length and Half Width
flatten_2 = List.Flatten(list=ui_multipleinputform.User_Inputs)
rooms_selected = CodeBlock(x=flatten_2) { x; }
geometry_2 = Element.Geometry(element=rooms_selected@L1)
boundingBox = Geometry.BoundingBox(geometry=geometry_2)
maxPoint = BoundingBox.MaxPoint(boundingBox=boundingBox)
# note: Custom Node: designtech v.1.0.8
point = dtGeometry.Deconstruct.Point(point=maxPoint)
minPoint = BoundingBox.MinPoint(boundingBox=boundingBox)
point_2 = dtGeometry.Deconstruct.Point(point=minPoint)
dy = point.y - point_2.y
code_block_15 = CodeBlock(y=dy) { Math.Ceiling((y/2)+1); }
dx = point.x - point_2.x
code_block_16 = CodeBlock(x=dx) { Math.Ceiling((x/2)+1); }

list_create_3 = List.Create(item0=code_block_15, item1=code_block_16)

# group: Set Elev Far Clip and Name per Room Name
code_block_17 = CodeBlock { "Far Clip Offset"; }
# note: Custom Node: WombatDynamo v.2.3.5
setParameterValuesByNames = WombatDynamo.Element.SetParameterValuesByNames(element=list_create_2@L2, parameterNames=code_block_17, values=list_create_3@L2)
# note: Custom Node: Clockwork v.2.3.0
passthrough = Custom[Passthrough](passThrough=transpose_2, waitFor=setParameterValuesByNames)  # package Clockwork for Dynamo 2.x; Forces a sequential order of execution. The node wired into the output of the Passthrough node will be executed *after* the node wired into the waitFor input (e.g. important for some Revit operations). The value of the passThrough input will be passed on to the node wired into the output port of the Passthrough node.
setParameterByName = Element.SetParameterByName(element=createElevationByMarkerIndex@L1, parameterName=code_block_13.out1, value=passthrough@L1)

code_block_18 = CodeBlock(x=createElevationByMarkerIndex) { x[0]; }
