# Dynamo graph script.dyn "Purge_IMPORT-LinePatterns" (Dynamo 2.16.1.2727)
# packages: Clockwork for Dynamo 2.x 2.4.0

# group: WIP
# note: "Work in Progress"

# group: Design
# note: For List Management \ Back-End Functionality

# group: Annotation
# note: For Comments

# group: Info
# note: Good to know stuff

# group: Annotation
# note: For notes and titles

# group: Change / Output
# note: For changes made to Revit or Other App

# group: Control
# note: For sliders and other options

# group: User Input
# note: For selection and whatnot

# group: Background
# note: For workflow

# group: REQUIRED PACKAGES
# note: Clockwork |

# group: REVIT PROJECT REPORT
# note: CREATED BY: Ren Rainville
# CREATED: 08/2019
# VERSION <1.5>
# LAST EDITED: 01/20/2023
# DYNAMO VERSION: <Dynamo 2.16>
# NOTES:
# If a CAD Import was exploded and the model was infected by IMPORT Line Patterns, have no fear, Dynamo is here! Purge those pesky line patterns and go about your day.

# group: Collect all Line Pattern Elements
string = StringInput("LinePatternElement")
# note: Custom Node: Clockwork
byName = Custom[ElementType.ByName](name=string)  # package Clockwork for Dynamo 2.x; Retrieves an element type by its name - to be used with the OOTB node "All Elements of Type".
all_elements_of_type = Custom[All Elements of Type+](elementType=byName)  # package Clockwork for Dynamo 2.x; Gets all placed elements of a given element type in the model. Unlike the OOTB node, it works for virtually all element types.

# group: Determine which are IMPORT Line Patterns
name = Element.Name(element=all_elements_of_type)
string_2 = StringInput("IMPORT")
startsWith = String.StartsWith(string=name, searchFor=string_2)

# group: Filter & DELETE
filterByBoolMask = List.FilterByBoolMask(list=all_elements_of_type, mask=startsWith)
delete = Element.Delete(element=filterByBoolMask.in)
