# Dynamo graph script.dyn "Purge_Materials-RenderMaterial" (Dynamo 2.12.0.5650)
# packages: archi-lab.net 2022.212.3222

# group: WIP
# note: "Work in Progress"

# group: Design
# note: For List Management \ Back-End Functionality

# group: Annotation
# note: For Comments

# group: Info
# note: Good to know stuff

# group: Annotation
# note: For notes and titles

# group: Change / Output
# note: For changes made to Revit or Other App

# group: Control
# note: For sliders and other options

# group: User Input
# note: For selection and whatnot

# group: Background
# note: For workflow

# group: REQUIRED PACKAGES
# note: archilab |  v.2022.212.3222

# group: REVIT PROJECT REPORT
# note: CREATED BY: Ren Rainville
# CREATED: 01/2020
# VERSION <1.0>
# LAST EDITED: 04/26/2022
# DYNAMO VERSION: <Dynamo 2.12>
# NOTES:
# Purge out Render Material materials, typically pulled in from a CAD Import.

# group: Collect all Materials in Project
code_block = CodeBlock { "Materials"; }
byName = Category.ByName(name=code_block)
all_elements_of_category = ElementsOfCategory(Category=byName)

# group: Filter out only Render Material materials
name = Element.Name(element=all_elements_of_category)
sortByKey = List.SortByKey(list=all_elements_of_category, keys=name)
code_block_2 = CodeBlock { "Render Material"; }
startsWith = String.StartsWith(string=sortByKey.sortedKeys, searchFor=code_block_2)
filterByBoolMask = List.FilterByBoolMask(list=sortByKey.sortedList, mask=startsWith)

# group: PURGE
# note: Custom Node: archilab v.2022.212.3222
delete = archilab.Revit.Elements.Elements.Delete(element=filterByBoolMask.in)
