# Dynamo graph script.dyn "Purge_UnusedRoomSeparationLines" (Dynamo 2.12.0.5650)
# packages: Clockwork for Dynamo 2.x 2.3.0, Ampersand 2022.1.25, archi-lab.net 2022.212.3222

# group: WIP
# note: "Work in Progress"

# group: Design
# note: For List Management \ Back-End Functionality

# group: Annotation
# note: For Comments

# group: Info
# note: Good to know stuff

# group: Annotation
# note: For notes and titles

# group: Change / Output
# note: For changes made to Revit or Other App

# group: Control
# note: For sliders and other options

# group: User Input
# note: For selection and whatnot

# group: Background
# note: For workflow

# group: REQUIRED PACKAGES
# note: Clockwork |  v.2.3.0
# Ampersand |  v.2022.1.25
# archilab |  v.2022.212.3222

# group: REVIT PROJECT REPORT
# note: CREATED BY: Ren Rainville
# CREATED: 01/2020
# VERSION <1.2>
# LAST EDITED: 04/26/2022
# DYNAMO VERSION: <Dynamo 2.12>
# NOTES:
# This tool finds all room separation lines, and tests that list to the room separation lines actually bounding rooms. It will delete the difference, ie the lines not bounding a room.

# group: Collect all Rooms
code_block = CodeBlock { "Rooms"; }
byName = Category.ByName(name=code_block)
all_elements_of_category = ElementsOfCategory(Category=byName)

# group: Room Separation Lines as Boundaries from Clockwork node
# note: Custom Node: Clockwork v.2.3.0
boundaries = Custom[Room.Boundaries](room=all_elements_of_category)  # package Clockwork for Dynamo 2.x; Gets a list of all boundaries of a given room or area and a corresponding list of the elements that are generating those boundaries.
flatten = List.Flatten(list=boundaries.elements)
type = Object.Type(object=flatten)
# note: Custom Node: Ampersand v.2022.1.25
list_groupbykey = Custom[[&] List.GroupByKey](objectList=flatten, keys=type)  # package Ampersand; Sort the items of a list into groups (sublists) based on the corresponding items of a reference list. Example: The list {A,B,C,D,E} with the reference list {1,anyWord,4,anyWord,1} will be grouped into lists as { {A,E}, {B,D}, {C} } and the unique references will be {1, anyWord, 4}.
code_block_2 = CodeBlock(x=list_groupbykey.unique_keys) { x; }
code_block_3 = CodeBlock { "Revit.Elements.ModelCurve"; }
indexOf = List.IndexOf(list=list_groupbykey.unique_keys, element=code_block_3)
getItemAtIndex = List.GetItemAtIndex(list=list_groupbykey.groups, index=indexOf)
uniqueItems = List.UniqueItems(list=getItemAtIndex)

# group: Collect all Room Separation Lines
code_block_4 = CodeBlock { "Lines - <Room Separation>"; }
byName_2 = Category.ByName(name=code_block_4)
all_elements_of_category_2 = ElementsOfCategory(Category=byName_2)

# group: Delete All the Things!
setDifference = List.SetDifference(list1=all_elements_of_category_2, list2=uniqueItems)
# note: Custom Node: archilab v.2022.212.3222
delete = archilab.Revit.Elements.Elements.Delete(element=setDifference)
