# Dynamo graph script.dyn "Query_ElementWorkset" (Dynamo 2.12.0.5650)
# packages: Clockwork for Dynamo 2.x 2.3.0, Data-Shapes 2022.2.103

# group: WIP
# note: "Work in Progress"

# group: Design
# note: For List Management \ Back-End Functionality

# group: Annotation
# note: For Comments

# group: Info
# note: Good to know stuff

# group: Annotation
# note: For notes and titles

# group: Change / Output
# note: For changes made to Revit or Other App

# group: Control
# note: For sliders and other options

# group: User Input
# note: For selection and whatnot

# group: Background
# note: For workflow

# group: REQUIRED PACKAGES
# note: Data-Shapes |  v.2022.2.103
# Clockwork |  v.2.3.0

# group: REVIT PROJECT REPORT
# note: CREATED BY: Ren Rainville
# CREATED: 10/2019
# VERSION <1.0>
# LAST EDITED: 04/26/2022
# DYNAMO VERSION: <Dynamo 2.12>
# NOTES:
# This tool grabs all elements in active view and exports element info (id, name and workset) to a predefined Excel file.

# group: User Interface Dialog Box
code_block = CodeBlock { "Select Directory for Excel Export"; }
file_path = Filename("H:\Dynamo\General\GGLO_logo_black.png")
code_block_2 = CodeBlock { "Engage"; "ABORT!"; }
code_block_3 = CodeBlock()
# ---------- code_block_3.designscript (2 lines) ----------
"Tool Tip";
"This Tool allows the user to select the folder in their Project Folder structure to place the exported excel file.";
# ----------------------------------------
# note: Custom Node: Data-Shapes v.2022.2.103
ui_textnote_data = Custom[UI.TextNote Data](Title=code_block_3.out0, TextNote=code_block_3.out1)  # package Data-Shapes; Create Data for TextNote input in UI.MultipleInputForm ++ . Check out www.data-shapes.net for more informations
code_block_4 = CodeBlock { "Set Directory Path to save exported Excel (.xlsx) File"; }
ui_directorypath_data = Custom[UI.DirectoryPath Data](InputName=code_block_4)  # package Data-Shapes; Creates a DirectoryPath input for UI.MultipleInputForm ++ . Check out www.data-shapes.net for more infos!
list_create = List.Create(item0=ui_textnote_data, item1=ui_directorypath_data)
boolean = BoolSelector(true)
code_block_5 = CodeBlock { "https://go.gglo.com/Production/SitePages/Dynamo.aspx"; }
ui_multipleinputform = Custom[UI.MultipleInputForm ++](Description_optional=code_block, Logo_optional=file_path, ButtonText_optional=code_block_2.out0, Inputs=list_create, Toggle=boolean, LinkToHelp_optional=code_block_5, CancelButtonText_optional=code_block_2.out1)  # package Data-Shapes; Create a form with multiple inputs. see www.data-shapes.net for tutorials and infos!
code_block_6 = CodeBlock(x=ui_multipleinputform.User_Inputs) { x[0]; }

# group: Get Element ID and Name, send to be made into List
all_elements_in_active_view = ElementsInView()
id = Element.Id(element=all_elements_in_active_view)
string_from_object = FromObject(object=all_elements_in_active_view)
name = Family.Name(family=all_elements_in_active_view)
code_block_7 = CodeBlock(elem=string_from_object, name=name) { elem + " - " + name; }
# note: Custom Node: Clockwork v.2.3.0
workset = Custom[Element.Workset](element=all_elements_in_active_view)  # package Clockwork for Dynamo 2.x; Retrieves the workset of a given element
name_2 = Custom[Element.Name+](element=workset)  # package Clockwork for Dynamo 2.x; Gets an element's name. Unlike the OOTB node, this node should work for all Revit elements that have names and will also return the localized names of system parameters, parameter groups, display unit types, parameter types, unit symbol types and unit types.
getCategory = Element.GetCategory(element=all_elements_in_active_view)

# group: Create Lists and Combine, Prep for Excel Export
code_block_8 = CodeBlock()
# ---------- code_block_8.designscript (4 lines) ----------
["ID",
"Element",
"Workset",
"Category"];
# ----------------------------------------
list_create_2 = List.Create(item0=id, item1=code_block_7, item2=name_2, item3=getCategory)
addItemToFront = List.AddItemToFront(item=code_block_8@L1, list=list_create_2@L2)
transpose = List.Transpose(lists=addItemToFront)

# group: Output to Excel
string = StringInput("\")
code_block_9 = CodeBlock { "Query_ElementWorksets.xlsx"; }
concat = String.Concat(string0=code_block_6, string1=string, string2=code_block_9)
code_block_10 = CodeBlock { "Sheet1"; }
code_block_11 = CodeBlock { 0; }
exportToExcel = Data.ExportToExcel(filePath=concat, sheetName=code_block_10, startRow=code_block_11, startColumn=code_block_11, data=transpose)
