# Dynamo graph script.dyn "Views_OnSheets-NotReferenced" (Dynamo 2.12.0.5650)
# packages: Clockwork for Dynamo 1.x 1.34.0, LunchBox for Dynamo 2018.7.6, archi-lab.net 2020.23.7, BumbleBee 2020.2.1, Data-Shapes 2019.2.42

# group: WIP
# note: "Work in Progress"

# group: Design
# note: For List Management \ Back-End Functionality

# group: Annotation
# note: For Comments

# group: Info
# note: Good to know stuff

# group: Annotation
# note: For notes and titles

# group: Change / Output
# note: For changes made to Revit or Other App

# group: Control
# note: For sliders and other options

# group: User Input
# note: For selection and whatnot

# group: Background
# note: For workflow

# group: REQUIRED PACKAGES
# note: Clockwork |  v.2.3.0
# LunchBox |  v.2018.7.6
# archilab |  v.2022.212.3222
# BumbleBee |  v.2021.25.3
# Data-Shapes |  v.2022.2.103

# group: REVIT PROJECT REPORT
# note: CREATED BY: Ren Rainville
# CREATED: 05/2021
# VERSION <1.0>
# LAST EDITED: 07/12/2022
# DYNAMO VERSION: <Dynamo 2.12>
# NOTES:
# This tool allows a user to set the directory where an excel file will be exported. Said, excel file will contain details on sheets without having referencing details. Views on sheets not referenced.

# group: Select Sheets where details should live A-5, L-5 or I-5 series Sheets
code_block = CodeBlock { "View"; }
# note: Custom Node: Clockwork v.2.3.0
byName = Custom[ElementType.ByName](name=code_block)  # package Clockwork for Dynamo 1.x; Retrieves an element type by its name - to be used with the OOTB node "All Elements of Type".
all_elements_of_type = ElementsOfType(element_type=byName)
# note: Custom Node: LunchBox v.2018.7.6
removeNulls = Lists.Manage.RemoveNulls(Data=all_elements_of_type)
type = Object.Type(object=removeNulls.Cleaned)
code_block_2 = CodeBlock { ".Sheet"; }
endsWith = String.EndsWith(string=type, searchFor=code_block_2)
filterByBoolMask = List.FilterByBoolMask(list=removeNulls.Cleaned, mask=endsWith)
code_block_3 = CodeBlock { "Sheet Number"; }
getParameterValueByName = Element.GetParameterValueByName(element=filterByBoolMask.in, parameterName=code_block_3)
code_block_4 = CodeBlock()
# ---------- code_block_4.designscript (3 lines) ----------
["A-5",
"L-5",
"I-5"];
# ----------------------------------------
startsWith = String.StartsWith(string=getParameterValueByName, searchFor=code_block_4@L1)
filterByBoolMask_2 = List.FilterByBoolMask(list=filterByBoolMask.in, mask=startsWith@L2)
code_block_5 = CodeBlock(list=filterByBoolMask_2.in) { DSCore.List.Flatten(list); }

sheets_views = CodeBlock(x=filterByBoolMask.in) { x; }
rest_of_views = CodeBlock(x=filterByBoolMask.out) { x; }

# group: Find Viewports without references
views = Sheet.Views(sheet=code_block_5@L2)
clean = List.Clean(list=views@L1)
code_block_6 = CodeBlock(views=clean) { DSCore.List.Flatten(views); }
# note: Custom Node: archilab v.2022.212.3222
viewports = archilab.Revit.Views.Sheets.Viewports(sheet=code_block_5)
clean_2 = List.Clean(list=viewports@L1)
code_block_7 = CodeBlock(views=clean_2) { DSCore.List.Flatten(views); }
code_block_8 = CodeBlock()
# ---------- code_block_8.designscript (2 lines) ----------
["Referencing Sheet",
"Referencing Detail"];
# ----------------------------------------
getParameterValueByName_2 = Element.GetParameterValueByName(element=code_block_7, parameterName=code_block_8@L1, lacing=CrossProduct)
code_block_9 = CodeBlock { ""; }
eq = getParameterValueByName_2 == code_block_9
allTrue = List.AllTrue(list=eq@L2)

# group: Sort Data, Append Column Headers to Front of Lists
filterByBoolMask_3 = List.FilterByBoolMask(list=code_block_6, mask=allTrue)
code_block_10 = CodeBlock(x=filterByBoolMask_3.in) { x; }
code_block_11 = CodeBlock(x=filterByBoolMask_3.in) { x.Parameters; }
code_block_12 = CodeBlock { ["View Name","Sheet Number","Detail Number"]; }
name = Element.Name(element=filterByBoolMask_3.in)
code_block_13 = CodeBlock { "Sheet Number"; "Detail Number"; }
getParameterValueByName_3 = Element.GetParameterValueByName(element=filterByBoolMask_3.in, parameterName=code_block_13.out0)
getParameterValueByName_4 = Element.GetParameterValueByName(element=filterByBoolMask_3.in, parameterName=code_block_13.out1)
list_create = List.Create(item0=name, item1=getParameterValueByName_3, item2=getParameterValueByName_4)
addItemToFront = List.AddItemToFront(item=code_block_12@L1, list=list_create@L2)

# group: User Interface Dialog Box
code_block_14 = CodeBlock { "Select Directory for Excel Export"; }
file_path = Filename("H:\Dynamo\General\GGLO_logo_black.png")
code_block_15 = CodeBlock { "Engage"; "ABORT!"; }
code_block_16 = CodeBlock()
# ---------- code_block_16.designscript (2 lines) ----------
"Tool Tip";
"This Tool allows the user to select the folder in their Project Folder structure to place the exported excel file.";
# ----------------------------------------
# note: Custom Node: Data-Shapes v.2022.2.103
ui_textnote_data = Custom[UI.TextNote Data](Title=code_block_16.out0, TextNote=code_block_16.out1)  # package Data-Shapes; Create Data for TextNote input in UI.MultipleInputForm ++ . Check out www.data-shapes.net for more informations
code_block_17 = CodeBlock { "Set Directory Path to save exported Excel (.xlsx) File"; }
ui_directorypath_data = Custom[UI.DirectoryPath Data](InputName=code_block_17)  # package Data-Shapes; Creates a DirectoryPath input for UI.MultipleInputForm ++ . Check out www.data-shapes.net for more infos!
list_create_2 = List.Create(item0=ui_textnote_data, item1=ui_directorypath_data)
boolean = BoolSelector(true)
code_block_18 = CodeBlock { "https://go.gglo.com/Production/SitePages/Dynamo.aspx"; }
ui_multipleinputform = Custom[UI.MultipleInputForm ++](Description_optional=code_block_14, Logo_optional=file_path, ButtonText_optional=code_block_15.out0, Inputs=list_create_2, Toggle=boolean, LinkToHelp_optional=code_block_18, CancelButtonText_optional=code_block_15.out1)  # package Data-Shapes; Create a form with multiple inputs. see www.data-shapes.net for tutorials and infos!
code_block_19 = CodeBlock(x=ui_multipleinputform.User_Inputs) { x[0]; }

# group: Export Data to Excel and Save to User Provided Directory
string = StringInput("\")
code_block_20 = CodeBlock { "Views_NotReferenced.xlsx"; }
concat = String.Concat(string0=code_block_19, string1=string, string2=code_block_20)
boolean_2 = BoolSelector(true)
code_block_21 = CodeBlock { true; }
code_block_22 = CodeBlock { "Sheet1"; }
code_block_23 = CodeBlock { "A1"; }
# note: Custom Node: BumbleBee v.2021.25.3
bb_data = Custom[BB Data](sheetName=code_block_22, origin=code_block_23, data=addItemToFront)  # package BumbleBee; This node is a building block for different modes of writing to Excel files. You can combines this node into a list to write to multiple sheets or use just one to write to a single sheet.
write_excel = Custom[Write Excel](filePath=concat, runIt=boolean_2, byColumn=code_block_21, BBData=bb_data)  # package BumbleBee; This node will write data to Excel file and based on how your BBData nodes are structured it will either override the exsting file, create a new one and write a single worksheet or write multiple worksheets.
