# Dynamo graph script.dyn "Views_DupRenameQuadParentViews" (Dynamo 2.16.1.2727)
# packages: Clockwork for Dynamo 2.x 2.4.0, designtech 1.0.8, Data-Shapes 2022.2.103

# group: WIP
# note: "Work in Progress"

# group: Design
# note: For List Management \ Back-End Functionality

# group: Annotation
# note: For Comments

# group: Info
# note: Good to know stuff

# group: Annotation
# note: For notes and titles

# group: Change / Output
# note: For changes made to Revit or Other App

# group: Control
# note: For sliders and other options

# group: User Input
# note: For selection and whatnot

# group: Background
# note: For workflow

# group: REQUIRED PACKAGES
# note: Clockwork | v2.4
# designtech | v.1.0.8
# Data-Shapes | v.2022.2.103

# group: REVIT PROJECT REPORT
# note: CREATED BY: Ren Rainville
# CREATED: 05/2023
# VERSION <1.1>
# LAST EDITED: 05/23/2023
# DYNAMO VERSION: <Dynamo 2.16>
# NOTES:
# This tool allows duplicating PARENT views as Dependents while naming them by the Quad Scope Box. It now includes a UI dialog box to ask user to include the view name suffix to select the PARENT views to duplicate as dependent.

# group: Get all Views (Output Names as Strings)
code_block = CodeBlock { "Views"; }
byName = Category.ByName(name=code_block)
all_elements_of_category = ElementsOfCategory(Category=byName)
code_block_2 = CodeBlock { false; }
clean = List.Clean(list=all_elements_of_category, preserveIndices=code_block_2)
code_block_3 = CodeBlock(v=clean) { v.Name; }

# group: User Input First Dialog
code_block_4 = CodeBlock { "Views - Duplicate Parent Views as Dependent, Name per Scope Box"; }
file_path = Filename("H:\Dynamo\General\GGLO_logo_black.png")
code_block_5 = CodeBlock { "Engage"; "ABORT!"; 600; 800; 300; }
code_block_6 = CodeBlock()
# ---------- code_block_6.designscript (2 lines) ----------
"Tool Tip";
"This Tool will ask the users for a suffix of a views to duplicate, it will duplicate the Parent view as dependent, remove ' - PARENT - Copy #' from the name and append the scope box name. Scope boxes for this process should include QUAD.";
# ----------------------------------------
# note: Custom Node: Data-Shapesv.2022.2.103
ui_textnote_data = Custom[UI.TextNote Data](Title=code_block_6.out0, TextNote=code_block_6.out1)  # package Data-Shapes; Create Data for TextNote input in UI.MultipleInputForm ++ . Check out www.data-shapes.net for more informations
code_block_7 = CodeBlock { "Enter Keyword to Search Group Names for Selection:"; "Search String"; false; }
ui_textbox_data = Custom[UI.TextBox Data](InputName=code_block_7.out0, DefaultText=code_block_7.out1, IsNumberEntry=code_block_7.out2)  # package Data-Shapes; Create Data for TextBox input in UI.MultipleInputForm ++ . Check out www.data-shapes.net for more informations
list_create = List.Create(item0=ui_textnote_data, item1=ui_textbox_data)
boolean = BoolSelector(true)
code_block_8 = CodeBlock { "https://go.gglo.com/Production/SitePages/Dynamo.aspx"; }
ui_multipleinputform = Custom[UI.MultipleInputForm ++](Description_optional=code_block_4, Logo_optional=file_path, ButtonText_optional=code_block_5.out0, Inputs=list_create, Toggle=boolean, LinkToHelp_optional=code_block_8, CancelButtonText_optional=code_block_5.out1, MaxHeight_optional=code_block_5.out2, Width_optional=code_block_5.out3, LabelWidth_optional=code_block_5.out4)  # package Data-Shapes; Create a form with multiple inputs. see www.data-shapes.net for tutorials and infos!
code_block_9 = CodeBlock(x=ui_multipleinputform.User_Inputs) { x[0]; }

# group: Filter to only Sector Plan Parent Views
contains = String.Contains(string=code_block_3, searchFor=code_block_9)
filterByBoolMask = List.FilterByBoolMask(list=clean, mask=contains)
code_block_10 = CodeBlock(x=filterByBoolMask.in) { x; }
isViewTemplate = View.IsViewTemplate(view=filterByBoolMask.in)
code_block_11 = CodeBlock { "SLAB - PARENT"; false; }
allIndicesOf = List.AllIndicesOf(list=isViewTemplate, item=code_block_11.out1)
getItemAtIndex = List.GetItemAtIndex(list=filterByBoolMask.in, index=allIndicesOf)

code_block_12 = CodeBlock(x=getItemAtIndex) { x; }

# group: Gather Scope Boxes that Contain 'QUAD' in the Name
code_block_13 = CodeBlock { "Scope Boxes"; }
byName_2 = Category.ByName(name=code_block_13)
all_elements_of_category_2 = ElementsOfCategory(Category=byName_2)
code_block_14 = CodeBlock(s=all_elements_of_category_2) { s.Name; }
code_block_15 = CodeBlock { "QUAD"; "QUADRANT"; }
contains_2 = String.Contains(string=code_block_14, searchFor=code_block_15.out0)
contains_3 = String.Contains(string=code_block_14, searchFor=code_block_15.out0)
or_ = contains_2 || contains_3
filterByBoolMask_2 = List.FilterByBoolMask(list=all_elements_of_category_2, mask=or_)
count = List.Count(list=filterByBoolMask_2.in)

# group: (Step #2) Remove any characters after " - " such as PARENT
code_block_16 = CodeBlock(v=getItemAtIndex) { v.Name; }
code_block_17 = CodeBlock { " - "; true; }
# note: Custom Node: designtechv.1.0.8
removeAfterCharacters = dtCore.String.RemoveAfterCharacters(str=code_block_16, characters=code_block_17.out0, includeChar=code_block_17.out1)

# group: Remove any characters before QUAD
code_block_18 = CodeBlock(e=filterByBoolMask_2.in) { e.Name; }
code_block_19 = CodeBlock { " - "; true; 0; }
insert = String.Insert(string=code_block_18, index=code_block_19.out2, toInsert=code_block_19.out0)
# note: Custom Node: designtechv.1.0.8
removeBeforeCharacters = dtCore.String.RemoveBeforeCharacters(str=code_block_18, characters=code_block_19.out0, includeChar=code_block_19.out1)  # frozen

# group: Aligning Lists
count_2 = List.Count(list=code_block_18)
ofRepeatedItem = List.OfRepeatedItem(item=removeAfterCharacters, amount=count_2)
transpose = List.Transpose(lists=ofRepeatedItem)
flatten = List.Flatten(list=transpose)
count_3 = List.Count(list=removeAfterCharacters)
ofRepeatedItem_2 = List.OfRepeatedItem(item=insert, amount=count_3)
flatten_2 = List.Flatten(list=ofRepeatedItem_2)

# group: Sets View Name Per Standard
list_create_2 = List.Create(item0=flatten, item1=flatten_2)
transpose_2 = List.Transpose(lists=list_create_2)
concat = String.Concat(string0=transpose_2@L2)

# group: (STEP #1) Duplicate Parent per # of Quads
ofRepeatedItem_3 = List.OfRepeatedItem(item=code_block_12, amount=count)
transpose_3 = List.Transpose(lists=ofRepeatedItem_3)
flatten_3 = List.Flatten(list=transpose_3)
# note: Custom Node: Clockwork
duplicateAsDependent = Custom[View.DuplicateAsDependent](view=flatten_3, name=concat)  # package Clockwork for Dynamo 2.x; Duplicates a given view as a dependent view

# group: Group Sector Plans by Sector
flatten_4 = List.Flatten(list=duplicateAsDependent)
code_block_20 = CodeBlock(v=duplicateAsDependent) { v.Name; }
code_block_21 = CodeBlock { -1; 1; }
substring = String.Substring(string=code_block_20, startIndex=code_block_21.out0, length=code_block_21.out1)
groupByKey = List.GroupByKey(list=flatten_4, keys=substring)

# group: Set Scope Box to Views
code_block_22 = CodeBlock { "Scope Box"; }
count_4 = List.Count(list=groupByKey.groups@L2)
ofRepeatedItem_4 = List.OfRepeatedItem(item=filterByBoolMask_2.in@L1, amount=count_4@L1)
setParameterByName = Element.SetParameterByName(element=groupByKey.groups, parameterName=code_block_22, value=ofRepeatedItem_4)

code_block_23 = CodeBlock(x=code_block_9) { x; }
