# Dynamo graph script.dyn "Views_UNIT_GroupsToAreaPlan" (Dynamo 2.16.1.2727)
# packages: Clockwork for Dynamo 2.x 2.4.0, MEPover 2022.10.30, WombatDynamo 2.3.5, Data-Shapes 2022.2.103, spring nodes 210.1.1, Genius Loci 2023.1.23, Rhythm 2023.2.2, Modelical 2022.6.15, archi-lab.net 2023.213.1722

# group: WIP
# note: "Work in Progress"

# group: Design
# note: For List Management \ Back-End Functionality

# group: Annotation
# note: For Comments

# group: Info
# note: Good to know stuff

# group: Annotation
# note: For notes and titles

# group: Change / Output
# note: For changes made to Revit or Other App

# group: Control
# note: For sliders and other options

# group: User Input
# note: For selection and whatnot

# group: Background
# note: For workflow

# group: REQUIRED PACKAGES
# note: Clockwork |  v.2.3.0
# MEPover |  v.2022.1.1
# designtech |  v.1.0.8
# WombatDynamo |  v.2.3.5
# Data-Shapes |  v.2022.2.103
# SteamNodes |  v.1.2.4
# spring nodes |  v.210.1.1
# Rhythm |  v.2021.4.2
# LunchBox |  v.2018.7.6
# GeniusLoci |  v.2022.3.9

# group: REVIT PROJECT REPORT
# note: CREATED BY: Mark Rainville
# CREATED: 04/2021
# VERSION <0.8>
# LAST EDITED: 07/13/2021
# DYNAMO VERSION: <Dynamo 2.3.0>
# NOTES:
# This tool allows a team member to set a String [Word(s)] for filtering UNIT Groups at Sea Level, it then creates dependent area plan and 3D views with view template and named per Unit Group Name, all views cropped to Group extents. Lastly, this tool sheets the views.

# group: Get All Model Groups
python_script = Python()  # CPython3
# ---------- python_script.python (35 lines) ----------
#Copyright(c) 2015, Konrad Sobon
# @arch_laboratory, http://archi-lab.net

import clr
clr.AddReference('ProtoGeometry')
from Autodesk.DesignScript.Geometry import *

# Import DocumentManager and TransactionManager
clr.AddReference("RevitServices")
import RevitServices
from RevitServices.Persistence import DocumentManager
from RevitServices.Transactions import TransactionManager

# Import RevitAPI
clr.AddReference("RevitAPI")
import Autodesk
from Autodesk.Revit.DB import *

doc = DocumentManager.Instance.CurrentDBDocument
uiapp = DocumentManager.Instance.CurrentUIApplication
app = uiapp.Application

from System.Collections.Generic import *

#The inputs to this node will be stored as a list in the IN variable.
dataEnteringNode = IN

collector = FilteredElementCollector(doc)
groups = collector.OfCategory(BuiltInCategory.OST_IOSModelGroups).WhereElementIsNotElementType().ToElements()

groupNames = []
for i in groups:
        groupNames.append(i.Name)

OUT = groupNames, groups
# ----------------------------------------
code_block = CodeBlock(OUT=python_script) { OUT[0]; OUT[1]; }
code_block_2 = CodeBlock(Groups=code_block.out1) { Groups; }

# group: LEVEL to Select
code_block_3 = CodeBlock { "SEA LEVEL"; }

# group: Select Only Specific Level Model Groups
# note: Custom Node: Clockwork
level = Custom[Element.Level](element=code_block_2)  # package Clockwork for Dynamo 2.x; Gets an element's level
groupByKey = List.GroupByKey(list=code_block_2, keys=level)
name = Element.Name(element=groupByKey.uniqueKeys)
startsWith = String.StartsWith(string=name, searchFor=code_block_3)
filterByBoolMask = List.FilterByBoolMask(list=groupByKey.groups, mask=startsWith)
flatten = List.Flatten(list=filterByBoolMask.in)

# group: Select All Titleblocks Loaded into the Project
python_script_selects_all_loaded = Python()  # "Python Script (Selects all loaded titleblock element types)"; CPython3
# ---------- python_script_selects_all_loaded.python (34 lines) ----------
import clr
import sys
import System
from System.Collections.Generic import List
clr.AddReference('ProtoGeometry')
from Autodesk.DesignScript.Geometry import *
import Autodesk.DesignScript.Geometry as DS

clr.AddReference('RevitAPI')
import Autodesk
from Autodesk.Revit.DB import *
import Autodesk.Revit.DB as DB

clr.AddReference('RevitServices')
import RevitServices
from RevitServices.Persistence import DocumentManager
from RevitServices.Transactions import TransactionManager

doc = DocumentManager.Instance.CurrentDBDocument

# Get all loaded families
famCollector = FilteredElementCollector(doc).OfClass(Family)
loadedFamilies = [f for f in famCollector if f.IsEditable]

# Filter the loaded families to only those that are Title Blocks
titleBlockFamilies = [f for f in loadedFamilies if f.FamilyCategory.Name == "Title Blocks"]

# Select all element types of the Title Block families
allTitleBlockTypes = []
for f in titleBlockFamilies:
    famTypes = FilteredElementCollector(doc).OfCategory(BuiltInCategory.OST_TitleBlocks).WhereElementIsElementType().ToElements()
    allTitleBlockTypes.extend(famTypes)

OUT = allTitleBlockTypes
# ----------------------------------------
uniqueItems = List.UniqueItems(list=python_script_selects_all_loaded)

# group: User Input First Dialog
code_block_4 = CodeBlock { "UNIT - Create AreaPlans, 3D Views and Sheet those Views"; }
file_path = Filename("H:\Dynamo\General\GGLO_logo_black.png")
code_block_5 = CodeBlock { "Engage"; "ABORT!"; 600; }
code_block_6 = CodeBlock()
# ---------- code_block_6.designscript (2 lines) ----------
"Tool Tip";
"This Tool will ask the users for a keyword to select Groups at Sea Level. The tool will then create Area Plans & 3D views all named per Group name then create sheets and place views.";
# ----------------------------------------
# note: Custom Node: Data-Shapesv.2022.2.103
ui_textnote_data = Custom[UI.TextNote Data](Title=code_block_6.out0, TextNote=code_block_6.out1)  # package Data-Shapes; Create Data for TextNote input in UI.MultipleInputForm ++ . Check out www.data-shapes.net for more informations
code_block_7 = CodeBlock { "Enter Keywork to Search Group Names for Selection:"; "Search String"; false; }
ui_textbox_data = Custom[UI.TextBox Data](InputName=code_block_7.out0, DefaultText=code_block_7.out1, IsNumberEntry=code_block_7.out2)  # package Data-Shapes; Create Data for TextBox input in UI.MultipleInputForm ++ . Check out www.data-shapes.net for more informations
code_block_8 = CodeBlock { "Use Existing Parent View or Create New?"; ["Use Existing","Create New"]; [0,1]; }
ui_radiobuttons_data = Custom[UI.RadioButtons Data](InputName=code_block_8.out0, Keys=code_block_8.out1, Values=code_block_8.out2)  # package Data-Shapes; Create radio buttons input for UI.MultipleInputForm ++ .
code_block_9 = CodeBlock { "Select Titleblock"; }
code_block_10 = CodeBlock(t=uniqueItems) { t.Name; }
ui_dropdown_data = Custom[UI.DropDown Data](InputName=code_block_9, Keys=code_block_10, Values=uniqueItems)  # package Data-Shapes; Create data for DropDown input in UI.MultiInputForm ++ . Check out www.data-shapes.net for more infos.
list_create = List.Create(item0=ui_textnote_data, item1=ui_textbox_data, item2=ui_radiobuttons_data, item3=ui_dropdown_data)
boolean = BoolSelector(true)
code_block_11 = CodeBlock { "https://go.gglo.com/Production/SitePages/Dynamo.aspx"; }
ui_multipleinputform = Custom[UI.MultipleInputForm ++](Description_optional=code_block_4, Logo_optional=file_path, ButtonText_optional=code_block_5.out0, Inputs=list_create, Toggle=boolean, LinkToHelp_optional=code_block_11, CancelButtonText_optional=code_block_5.out1, Width_optional=code_block_5.out2)  # package Data-Shapes; Create a form with multiple inputs. see www.data-shapes.net for tutorials and infos!
code_block_12 = CodeBlock(x=ui_multipleinputform.User_Inputs) { x[0]; x[1]; x[2]; }

# group: Select Groups
name_2 = Element.Name(element=flatten)
contains = String.Contains(string=name_2, searchFor=code_block_12.out0)
filterByBoolMask_2 = List.FilterByBoolMask(list=flatten, mask=contains)
name_3 = Element.Name(element=filterByBoolMask_2.in)
uniqueItems_2 = List.UniqueItems(list=name_3)
code_block_13 = CodeBlock(x=name_2) { x; }
code_block_14 = CodeBlock(x=filterByBoolMask_2.in) { x; }

use_existing_0_create_new_1 = CodeBlock(x=code_block_12.out1) { x; }
code_block_15 = CodeBlock { 0; 1; }
if_ = RefactoredIf(test=use_existing_0_create_new_1, true=code_block_15.out0, false=code_block_15.out1)

# group: Secondary Dialog box
code_block_16 = CodeBlock { "Select Area Scheme"; }
python_script_2 = Python()  # CPython3
# ---------- python_script_2.python (22 lines) ----------
import clr

clr.AddReference('RevitAPI')
import Autodesk.Revit.DB as DB

clr.AddReference('RevitServices')
from RevitServices.Persistence import DocumentManager
doc = DocumentManager.Instance.CurrentDBDocument

clr.AddReference('RevitNodes')
import Revit
clr.ImportExtensions(Revit.Elements)

ueWrapper = None
wrappers = clr.GetClrType(Revit.Elements.ElementWrapper).GetMethods()
for w in wrappers:
        if w.ToString().startswith("Revit.Elements.UnknownElement"):
                ueWrapper = w
                break

fec = DB.FilteredElementCollector(doc).OfClass(DB.AreaScheme).ToElements()
OUT = fec
# ----------------------------------------
name_4 = Element.Name(element=python_script_2)
# note: Custom Node: Data-Shapesv.2022.2.103
ui_dropdown_data_2 = Custom[UI.DropDown Data](InputName=code_block_16, Keys=name_4, Values=python_script_2)
code_block_17 = CodeBlock { "Select Area Plan View Template"; }
python_script_3 = Python()  # CPython3
# ---------- python_script_3.python (25 lines) ----------
import clr

clr.AddReference('RevitAPI')
import Autodesk.Revit.DB as DB

clr.AddReference('RevitServices')
from RevitServices.Persistence import DocumentManager
doc = DocumentManager.Instance.CurrentDBDocument

clr.AddReference('RevitNodes')
import Revit
clr.ImportExtensions(Revit.Elements)

ueWrapper = None
wrappers = clr.GetClrType(Revit.Elements.ElementWrapper).GetMethods()
for w in wrappers:
        if w.ToString().startswith("Revit.Elements.UnknownElement"):
                ueWrapper = w
                break

fec = DB.FilteredElementCollector(doc).OfClass(DB.View)
OUT = []
for i in fec:
        if i.IsTemplate:
                OUT.append(ueWrapper.Invoke(None, (i, True) ))
# ----------------------------------------
name_5 = Element.Name(element=python_script_3)
ui_dropdown_data_3 = Custom[UI.DropDown Data](InputName=code_block_17, Keys=name_5, Values=python_script_3)
code_block_18 = CodeBlock { "Select 3D View to Duplicate"; }
# note: Custom Node: Modelicalv.2022.6.15
getViewsByType = Custom[GetViewsByType]()  # package Modelical; This node gets all views in the project classified by type.
code_block_19 = CodeBlock(v=getViewsByType.threeD) { v.Name; }
code_block_20 = CodeBlock { "{"; }
startsWith_2 = String.StartsWith(string=code_block_19, searchFor=code_block_20)
filterByBoolMask_3 = List.FilterByBoolMask(list=getViewsByType.threeD, mask=startsWith_2)
code_block_21 = CodeBlock(v=filterByBoolMask_3.out) { v.Name; }
ui_dropdown_data_4 = Custom[UI.DropDown Data](InputName=code_block_18, Keys=code_block_21, Values=filterByBoolMask_3.out)
list_create_2 = List.Create(item0=ui_dropdown_data_2, item1=ui_dropdown_data_3, item2=ui_dropdown_data_4)
ui_multipleinputform_2 = Custom[UI.MultipleInputForm ++](Description_optional=code_block_4, Logo_optional=file_path, ButtonText_optional=code_block_5.out0, Inputs=list_create_2, Toggle=use_existing_0_create_new_1, LinkToHelp_optional=code_block_11, CancelButtonText_optional=code_block_5.out1)
code_block_22 = CodeBlock(x=ui_multipleinputform_2.User_Inputs) { x[0]; x[1]; x[2]; }
code_block_23 = CodeBlock { "Select Existing FloorPlan as Parent View"; }
# note: Custom Node: Rhythmv.2023.2.2
ʳʰʸᵗʰᵐ_view_parentview = Rhythm.Revit.Views.View.ParentView(view=getViewsByType.areaPlans)
string_from_object = FromObject(obj=ʳʰʸᵗʰᵐ_view_parentview)
code_block_24 = CodeBlock { "No parent"; }
contains_2 = String.Contains(string=string_from_object, searchFor=code_block_24)
filterByBoolMask_4 = List.FilterByBoolMask(list=getViewsByType.areaPlans, mask=contains_2)
code_block_25 = CodeBlock(v=filterByBoolMask_4.in) { v.Name; }
ui_dropdown_data_5 = Custom[UI.DropDown Data](InputName=code_block_23, Keys=code_block_25, Values=filterByBoolMask_4.in)
list_create_3 = List.Create(item0=ui_dropdown_data_5, item1=ui_dropdown_data_4)
ui_multipleinputform_3 = Custom[UI.MultipleInputForm ++](Description_optional=code_block_4, Logo_optional=file_path, ButtonText_optional=code_block_5.out0, Inputs=list_create_3, Toggle=if_, LinkToHelp_optional=code_block_11, CancelButtonText_optional=code_block_5.out1)
code_block_26 = CodeBlock(x=ui_multipleinputform_3.User_Inputs) { x[0]; x[1]; }
code_block_27 = CodeBlock(x=getViewsByType.areaPlans) { x; }
code_block_28 = CodeBlock(x=getViewsByType.threeD) { x; }

start = Revit.Transaction.Transaction.Start(input=code_block_22.out0)

# group: Create Area Plan if not Already Created
code_block_29 = CodeBlock(x=code_block_14) { x[0]; }
# note: Custom Node: Clockwork
level_2 = Custom[Element.Level](element=code_block_29)
name_6 = Element.Name(element=start)
code_block_30 = CodeBlock(x=code_block_12.out0) { "View Name"; x+"-Parent"; }

# group: Test if UNIT-Parent AreaPlan View is Already Created, if so pass it, if not make it
code_block_31 = CodeBlock { "input"; }
python_script_4 = Python(IN[0]=code_block_31)  # CPython3
# ---------- python_script_4.python (41 lines) ----------
import clr

clr.AddReference('RevitAPI')
from Autodesk.Revit.DB import *
from Autodesk.Revit.DB.Structure import *

clr.AddReference('RevitAPIUI')
from Autodesk.Revit.UI import *

clr.AddReference('System')
from System.Collections.Generic import List

clr.AddReference('RevitNodes')
import Revit
clr.ImportExtensions(Revit.GeometryConversion)
clr.ImportExtensions(Revit.Elements)

clr.AddReference('RevitServices')
import RevitServices
from RevitServices.Persistence import DocumentManager
from RevitServices.Transactions import TransactionManager

doc = DocumentManager.Instance.CurrentDBDocument
uidoc=DocumentManager.Instance.CurrentUIApplication.ActiveUIDocument

areaPlans = []
#collect all views in the model
collector = FilteredElementCollector(doc)
views = collector.OfClass(View).ToElements()

for i in views:
        if not i.IsTemplate:
                if i.ViewType == ViewType.AreaPlan and i.Name == "UNIT-Parent":
                        areaPlans.append(i.ToDSType(True))
#Do some action in a Transaction
#TransactionManager.Instance.EnsureInTransaction(doc)

#TransactionManager.Instance.TransactionTaskDone()

# Assign your output to the OUT variable.
OUT = areaPlans
# ----------------------------------------
isEmpty = List.IsEmpty(list=python_script_4)
list_create_4 = List.Create(item0=python_script_4, item1=level_2)
code_block_32 = CodeBlock { [true, false]; [1,0]; }
# note: Custom Node: spring nodesv.210.1.1
ꟿ_dictionary_bykeysvalues = Custom[ꟿ Dictionary.ByKeysValues](keys=code_block_32.out0, values=code_block_32.out1, searchKeys=isEmpty)  # package spring nodes; Dictionaries are an incredibly powerful tool for making associative sets between two equal length lists. The first list must be of unique strings (or numbers) and will be the key and the second list will be the matching values (it can be made up of geometry, elements, even other lists) The search keys list will provide the corresponding value to the input key.
getItemAtIndex = List.GetItemAtIndex(list=list_create_4, index=ꟿ_dictionary_bykeysvalues)
code_block_33 = CodeBlock { null; }
if_2 = RefactoredIf(test=isEmpty, true=getItemAtIndex, false=code_block_33)
flatten_2 = List.Flatten(list=if_2)

# group (continued): Create Area Plan if not Already Created
# note: Custom Node: WombatDynamov.2.3.5
byLevelAndSchemeName = WombatDynamo.AreaPlanView.ByLevelAndSchemeName(level=flatten_2, schemeName=name_6)
setParameterByName = Element.SetParameterByName(element=byLevelAndSchemeName, parameterName=code_block_30.out0, value=code_block_30.out1)

if_3 = RefactoredIf(test=use_existing_0_create_new_1, true=setParameterByName, false=code_block_26.out0)

# group (continued): Test if UNIT-Parent AreaPlan View is Already Created, if so pass it, if not make it
list_create_5 = List.Create(item0=python_script_4, item1=if_3)
getItemAtIndex_2 = List.GetItemAtIndex(list=list_create_5, index=ꟿ_dictionary_bykeysvalues)
flatten_3 = List.Flatten(list=getItemAtIndex_2)

if_4 = RefactoredIf(test=use_existing_0_create_new_1, true=flatten_3, false=code_block_26.out0)

# group: Set View Template, Either From Parent View or If New View, From Dialog Selection
code_block_34 = CodeBlock(x=code_block_22.out1) { x; }
viewTemplate = Python(IN[0]=code_block_26.out0)  # "View.ViewTemplate"; CPython3
# ---------- viewTemplate.python (15 lines) ----------
import clr
clr.AddReference('RevitAPI')
from Autodesk.Revit.DB import *

def GetViewTemplate(view):
        if not view: return None
        elif hasattr(view, "ViewTemplateId"):
                if view.ViewTemplateId.IntegerValue == -1: return None
                else: return view.Document.GetElement(view.ViewTemplateId)
        else: return None

views = UnwrapElement(IN[0])

if isinstance(IN[0], list): OUT = [GetViewTemplate(x) for x in views]
else: OUT = GetViewTemplate(views)
# ----------------------------------------
if_5 = RefactoredIf(test=use_existing_0_create_new_1, true=code_block_34, false=viewTemplate)
if_6 = RefactoredIf(test=use_existing_0_create_new_1, true=code_block_22.out2, false=code_block_26.out1)

# group: Apply View Template
name_7 = Element.Name(element=if_5)
# note: Custom Node: GeniusLociv.2023.1.23
view_applyviewtemplate = Custom[View ApplyViewTemplate](view=if_4, viewTemplate=name_7)  # package Genius Loci; Applies to the given view the properties that are not controlled by the assigned view template. (Similar to the "Apply Template Properties" command of Revit)

areaplans_transaction_end = Revit.Transaction.Transaction.End(input=view_applyviewtemplate)

# group: Group / Unit Name
name_8 = Element.Name(element=code_block_14)
flatten_4 = List.Flatten(list=name_8)

get_areascheme = Python(IN[0]=if_4)  # CPython3
# ---------- get_areascheme.python (22 lines) ----------
import clr

clr.AddReference('RevitAPI')
import Autodesk.Revit.DB as DB

clr.AddReference('RevitServices')
from RevitServices.Persistence import DocumentManager
doc = DocumentManager.Instance.CurrentDBDocument

clr.AddReference('RevitNodes')
import Revit
clr.ImportExtensions(Revit.Elements)

areascheme = []

viewlist = UnwrapElement(IN[0])

#for i in viewlist:
#       areascheme.append(i.AreaScheme)

areascheme = viewlist[0].AreaScheme
OUT = areascheme
# ----------------------------------------

# group: Formerly Lunchbox - AreaPlan Element Collector (Collect any already created views and cull)
boolean_2 = BoolSelector(true)
boolean_toggle = CodeBlock(x=boolean_2) { x; }
if_7 = RefactoredIf(test=use_existing_0_create_new_1, true=code_block_22.out0, false=get_areascheme)
area_scheme_name = CodeBlock(x=if_7) { x.Name; }
python_script_5 = Python(IN[0]=boolean_toggle, IN[1]=area_scheme_name)  # CPython3
# ---------- python_script_5.python (77 lines) ----------
#Copyright(c) 2014, Nathan Miller
# The Proving Ground, http://theprovingground.org

import clr

# Import RevitAPI
clr.AddReference("RevitAPI")
import Autodesk
from Autodesk.Revit.DB import *

# Import DocumentManager and TransactionManager
clr.AddReference("RevitServices")
import RevitServices
from RevitServices.Persistence import DocumentManager
from RevitServices.Transactions import TransactionManager

# Import ToDSType(bool) extension method
clr.AddReference("RevitNodes")
import Revit
clr.ImportExtensions(Revit.Elements)
clr.ImportExtensions(Revit.GeometryConversion)

#The input to this node will be stored in the IN[0] variable.

doc =  DocumentManager.Instance.CurrentDBDocument

toggle = IN[0]
schemeName = IN[1]

output = []
views = []
names = []
elementids = []
uniqueids = []

if toggle == True:

        collector = FilteredElementCollector(doc)
        collector.OfCategory(BuiltInCategory.OST_Views)
        collector.OfClass(View)
 
        famtypeitr = collector.GetElementIdIterator()
        famtypeitr.Reset()

        for item in famtypeitr:
                famtypeID = item
                faminst = doc.GetElement(famtypeID)
                
                if faminst.ViewType == ViewType.AreaPlan:
                        if (faminst.AreaScheme.Name == schemeName):
                                view = faminst
                                name = faminst.Name
                                elementid = faminst.Id
                                uniqueid = faminst.UniqueId
                                
                                views.append(view)
                                names.append(name)
                                elementids.append(elementid)
                                uniqueids.append(uniqueid)
                        if (schemeName == "*"):
                                view = faminst
                                name = faminst.Name
                                elementid = faminst.Id
                                uniqueid = faminst.UniqueId
                                
                                views.append(view)
                                names.append(name)
                                elementids.append(elementid)
                                uniqueids.append(uniqueid)
        
        output.append(views)
        output.append(names)
        output.append(elementids)
        output.append(uniqueids)
        
#Assign your output to the OUT variable
OUT = output
# ----------------------------------------
code_block_35 = CodeBlock(x=python_script_5) { view = x[0]; name = x[1]; ElementID = x[2]; UniqueID = x[3]; }

# group: Check if Views were Already Created
contains_3 = String.Contains(string=code_block_35.name@L1, searchFor=flatten_4)
code_block_36 = CodeBlock { true; }
allIndicesOf = List.AllIndicesOf(list=contains_3@L2, item=code_block_36)
flatten_5 = List.Flatten(list=allIndicesOf)
removeItemAtIndex = List.RemoveItemAtIndex(list=flatten_4, indices=flatten_5)
list_create_6 = List.Create(item0=removeItemAtIndex, item1=flatten_4)
code_block_37 = CodeBlock { [true, false]; [1,0]; }
isEmpty_2 = List.IsEmpty(list=contains_3)
# note: Custom Node: spring nodesv.210.1.1
ꟿ_dictionary_bykeysvalues_2 = Custom[ꟿ Dictionary.ByKeysValues](keys=code_block_37.out0, values=code_block_37.out1, searchKeys=isEmpty_2)
getItemAtIndex_3 = List.GetItemAtIndex(list=list_create_6, index=ꟿ_dictionary_bykeysvalues_2)
removeItemAtIndex_2 = List.RemoveItemAtIndex(list=code_block_14, indices=flatten_5)
list_create_7 = List.Create(item0=removeItemAtIndex_2, item1=code_block_14)
getItemAtIndex_4 = List.GetItemAtIndex(list=list_create_7, index=ꟿ_dictionary_bykeysvalues_2)

# group: Duplicate Area Plan (as Dependent) for Each Group
count = List.Count(list=getItemAtIndex_3@L2)
ofRepeatedItem = List.OfRepeatedItem(item=if_4, amount=count)
flatten_6 = List.Flatten(list=ofRepeatedItem)
# note: Custom Node: Clockwork
duplicateAsDependent = Custom[View.DuplicateAsDependent](view=flatten_6, name=getItemAtIndex_3)  # package Clockwork for Dynamo 2.x; Duplicates a given view as a dependent view
code_block_38 = CodeBlock(x=duplicateAsDependent) { x; }

# group: Get Crop Region for Floor Plans from Group Bounding Box, Enlarge with Buffer Value to Show Dimensions
boundingBox = Element.BoundingBox(element=getItemAtIndex_4@L1)
minPoint = BoundingBox.MinPoint(boundingBox=boundingBox)
X = Point.X(point=minPoint)
buffer_from_group_bounding_box = CodeBlock { 8; }  # "Buffer from Group Bounding Box to Show Dimensions"
code_block_39 = CodeBlock(x=X, n=buffer_from_group_bounding_box) { x-n; }
Y = Point.Y(point=minPoint)
code_block_40 = CodeBlock(y=Y, n=buffer_from_group_bounding_box) { y-n; }
byCoordinates = Point.ByCoordinates(x=code_block_39, y=code_block_40)
maxPoint = BoundingBox.MaxPoint(boundingBox=boundingBox)
Y_2 = Point.Y(point=maxPoint)
code_block_41 = CodeBlock(y=Y_2, n=buffer_from_group_bounding_box) { y+n; }
byCoordinates_2 = Point.ByCoordinates(x=code_block_39, y=code_block_41)
X_2 = Point.X(point=maxPoint)
code_block_42 = CodeBlock(x=X_2, n=buffer_from_group_bounding_box) { x+n; }
byCoordinates_3 = Point.ByCoordinates(x=code_block_42, y=code_block_41)
byCoordinates_4 = Point.ByCoordinates(x=code_block_42, y=code_block_40)
byCornerPoints = Rectangle.ByCornerPoints(p1=byCoordinates, p2=byCoordinates_2, p3=byCoordinates_3, p4=byCoordinates_4)
curves = PolyCurve.Curves(polyCurve=byCornerPoints)

# group: Set Crop Box from Bounding Box
# note: Custom Node: MEPoverv.2022.10.30
setCropBoxCurves = Custom[View.SetCropBoxCurves](views=code_block_38@L1, curves=curves@L2)  # package MEPover; Input views and lists of curves to set the view crop regions

flatten_7 = List.Flatten(list=setCropBoxCurves)
# note: Custom Node: archilab
clear_list = Custom[Clear List](input=flatten_7)  # package archi-lab.net; This node will remove all Null and Empty Lists from any list.
code_block_43 = CodeBlock(x=clear_list) { x; }
code_block_44 = CodeBlock(v=code_block_43) { v.Name; }

# group: (Optional) Appended User Info to Sheet Name and Number
code_block_45 = CodeBlock { " - "; }
code_block_46 = CodeBlock { "Test"; }
addItemToEnd = List.AddItemToEnd(item=code_block_46, list=code_block_44@L1)
join = String.Join(separator=code_block_45, string0=addItemToEnd)
flatten_8 = List.Flatten(list=join)

n3d_views_transaction_end = Revit.Transaction.Transaction.End()  # "3D Views (Transaction.End)"; unwired: input
join_2 = List.Join(list0=setCropBoxCurves, list1=n3d_views_transaction_end)
code_block_47 = CodeBlock(passthrough=code_block_12.out2, waitfor=clear_list) { [passthrough,waitfor][0]; }
count_2 = List.Count(list=code_block_43)
ofRepeatedItem_2 = List.OfRepeatedItem(item=code_block_47, amount=count_2)
code_block_48 = CodeBlock(x=code_block_44) { x; }
code_block_49 = CodeBlock { 0; 5; }
remove = String.Remove(string=code_block_48, startIndex=code_block_49.out0, count=code_block_49.out1)

# group: Create Sheets, Set Name and Number
# note: Custom Node: Rhythmv.2023.2.2
ʳʰʸᵗʰᵐ_sheet_create = Rhythm.Revit.Elements.Sheet.Create(titleblock=ofRepeatedItem_2@L2)
code_block_50 = CodeBlock { "Sheet Name"; "Sheet Number"; }
setParameterByName_2 = Element.SetParameterByName(element=ʳʰʸᵗʰᵐ_sheet_create@L2, parameterName=code_block_50.out0, value=remove)
setParameterByName_3 = Element.SetParameterByName(element=setParameterByName_2@L2, parameterName=code_block_50.out1, value=remove)

# group: Place Views on Sheets and Set Sheet Discipline for Sorting
code_block_51 = CodeBlock(x=code_block_12.out0) { "Sheet Discipline"; "09-"+x; x; }
setParameterByName_4 = Element.SetParameterByName(element=setParameterByName_3, parameterName=code_block_51.out0, value=code_block_51.out1)
code_block_52 = CodeBlock(x=code_block_51.x) { "Drawing Set"; x+"-PACKAGE"; }
setParameterByName_5 = Element.SetParameterByName(element=setParameterByName_4, parameterName=code_block_52.out0, value=code_block_52.out1)
views = CodeBlock(x=code_block_43) { x; }
code_block_53 = CodeBlock { 0.37375; 0.510417; 0; }
byCoordinates_5 = Point.ByCoordinates(x=code_block_53.out0, y=code_block_53.out1, z=code_block_53.out2)
count_3 = List.Count(list=views)
ofRepeatedItem_3 = List.OfRepeatedItem(item=byCoordinates_5, amount=count_3)
# note: Custom Node: Rhythmv.2023.2.2
ʳʰʸᵗʰᵐ_viewport_create = Rhythm.Revit.Elements.Viewport.Create(sheet=setParameterByName_3@L1, view=views@L1, location=ofRepeatedItem_3@L1)

# group: Testing
number_slider = DoubleSlider(5, range=1..20 step 1)
takeItems = List.TakeItems(list=filterByBoolMask_2.in, amount=number_slider)

# group: Set Viewports to 'No Title'
code_block_54 = CodeBlock { "Family and Type"; }
get_all_viewport_types = Python()  # "Get All Viewport Types (depricated archi-lab.net)"; CPython3
# ---------- get_all_viewport_types.python (43 lines) ----------
# Copyright(c) 2015, Konrad K Sobon
# @arch_laboratory, http://archi-lab.net

import clr
# Import Element wrapper extension methods
clr.AddReference("RevitNodes")
import Revit
clr.ImportExtensions(Revit.Elements)

# Import DocumentManager and TransactionManager
clr.AddReference("RevitServices")
import RevitServices
from RevitServices.Persistence import DocumentManager
doc = DocumentManager.Instance.CurrentDBDocument

import sys
pyt_path = r'C:\Program Files (x86)\IronPython 2.7\Lib'
sys.path.append(pyt_path)

# Import RevitAPI
clr.AddReference("RevitAPI")
import Autodesk
from Autodesk.Revit.DB import *

#The inputs to this node will be stored as a list in the IN variable.
dataEnteringNode = IN

try:
        errorReport = None
        viewports = FilteredElementCollector(doc).OfCategory(BuiltInCategory.OST_Viewports).WhereElementIsNotElementType().ToElements()
        #for i in viewports[0]:
            #types.append(doc.GetElement(i))
        #types = [doc.GetElement(i) for i in viewports[0].GetValidTypes()]
except:
        # if error accurs anywhere in the process catch it
        import traceback
        errorReport = traceback.format_exc()

#Assign your output to the OUT variable
if errorReport == None:
        OUT = viewports
else:
        OUT = errorReport
# ----------------------------------------
code_block_55 = CodeBlock(e=get_all_viewport_types) { e.Name; }
code_block_56 = CodeBlock { "No Title"; }
contains_4 = String.Contains(string=code_block_55, searchFor=code_block_56)
filterByBoolMask_5 = List.FilterByBoolMask(list=get_all_viewport_types, mask=contains_4)
count_4 = List.Count(list=ʳʰʸᵗʰᵐ_viewport_create)
ofRepeatedItem_4 = List.OfRepeatedItem(item=filterByBoolMask_5.in, amount=count_4)
setParameterByName_6 = Element.SetParameterByName(element=ʳʰʸᵗʰᵐ_viewport_create, parameterName=code_block_54, value=ofRepeatedItem_4)

# group: Get Dynamo Player to Report Success
name_9 = Element.Name(element=setParameterByName_6@L2)
isNull = Object.IsNull(object=name_9@L2)
allTrue = List.AllTrue(list=isNull@L2)
code_block_57 = CodeBlock { "Uh Oh, something went wrong."; "Success!"; }
if_8 = RefactoredIf(test=allTrue, true=code_block_57.out0, false=code_block_57.out1)
code_block_58 = CodeBlock(x=if_8) { x[0]; }
player_output = Watch(code_block_58)  # graph output

code_block_59 = CodeBlock(x=code_block_22.out0) { x; }
python_script_selects_titleblock = Python()  # "Python Script (selects titleblock instances)"; CPython3; frozen
# ---------- python_script_selects_titleblock.python (24 lines) ----------
import clr
import sys
import System
from System.Collections.Generic import List
clr.AddReference('ProtoGeometry')
from Autodesk.DesignScript.Geometry import *
import Autodesk.DesignScript.Geometry as DS

clr.AddReference('RevitAPI')
import Autodesk
from Autodesk.Revit.DB import *
import Autodesk.Revit.DB as DB

clr.AddReference('RevitServices')
import RevitServices
from RevitServices.Persistence import DocumentManager
from RevitServices.Transactions import TransactionManager

doc = DocumentManager.Instance.CurrentDBDocument

filterAnnot = System.Predicate[System.Object](lambda x : x.Family.FamilyCategory.CategoryType == CategoryType.Annotation)
symbAnnot = List[Element](FilteredElementCollector(doc).OfClass(FamilySymbol).ToElements()).FindAll(filterAnnot)

OUT = symbAnnot
# ----------------------------------------
code_block_60 = CodeBlock(x=ui_multipleinputform_2.User_Inputs) { x; }
