# Dynamo graph script.dyn "Align_CurtainGrids-HorizToLevels" (Dynamo 2.18.1.5096)
# packages: Rhythm 2023.9.1, Clockwork for Dynamo 2.x 2.6.0, Data-Shapes 2023.2.112, Genius Loci 2023.7.13, WombatDynamo 2.3.5

# group: WIP
# note: "Work in Progress"

# group: Design
# note: For List Management \ Back-End Functionality

# group: Annotation
# note: For Comments

# group: Info
# note: Good to know stuff

# group: Annotation
# note: For notes and titles

# group: Change / Output
# note: For changes made to Revit or Other App

# group: Control
# note: For sliders and other options

# group: User Input
# note: For selection and whatnot

# group: Background
# note: For workflow

# group: REQUIRED PACKAGES
# note: Rhythm | v.2023.9.1
# Clockwork | v.2.4
# Data-Shapes | v.2023.2.112
# GeniusLoci | v.2023.7.13
# WombatDynamo | v.2.3.5

# group: REVIT PROJECT REPORT
# note: CREATED BY: Ren Rainville
# CREATED: 11/2019
# VERSION <1.2>
# LAST EDITED: 11/14/2023
# DYNAMO VERSION: <Dynamo 2.18>
# NOTES:
# This graph takes a single curtain wall element, user selected, and aligns horizontal grid lines to the levels. It takes the wall location elevation and only picks levels above the wall base. Additional features include option for Imperial vs Metric projects, as well as input for keyword or prefix to select specific levels (as in 'Starts with' Bldg Abbrev. letter or number or Contains Level, Amenity, etc.).
# IronPython2 converted to CPython3

# group: MultipleInputFormUI++ (Asks User for Input Data to Run)
code_block = CodeBlock { "Sorting Levels for Alignment"; }
file_path = Filename("H:\Dynamo\General\GGLO_logo_black.png")
code_block_2 = CodeBlock { "Engage"; "ABORT!"; }
code_block_3 = CodeBlock()
# ---------- code_block_3.designscript (2 lines) ----------
"Tool Tip";
"This Tool will allow the user to select specific levels to which the existing horizontal grids will be aligned.";
# ----------------------------------------
# note: Custom Node: Data-Shapesv.2023.2.112
ui_textnote_data = Custom[UI.TextNote Data](Title=code_block_3.out0, TextNote=code_block_3.out1)  # package Data-Shapes; Create Data for TextNote input in UI.MultipleInputForm ++ . Check out www.data-shapes.net for more informations
code_block_4 = CodeBlock { "Enter Level Keyword or Prefix: ('LEVEL' or Bldg Number or Letter)"; "Level Keyword / Prefix"; false; }
ui_textbox_data = Custom[UI.TextBox Data](InputName=code_block_4.out0, DefaultText=code_block_4.out1, IsNumberEntry=code_block_4.out2)  # package Data-Shapes; Create Data for TextBox input in UI.MultipleInputForm ++ . Check out www.data-shapes.net for more informations
code_block_5 = CodeBlock { "Select if the Text is a Keyword or Prefix:"; ["Keyword","Prefix"]; [0,1]; }
ui_dropdown_data = Custom[UI.DropDown Data](InputName=code_block_5.out0, Keys=code_block_5.out1, Values=code_block_5.out2)  # package Data-Shapes; Create data for DropDown input in UI.MultiInputForm ++ . Check out www.data-shapes.net for more infos.
code_block_6 = CodeBlock { "Select Project Units (Imperial / Metric):"; ["Imperial","Metric"]; [0,1]; }
ui_dropdown_data_2 = Custom[UI.DropDown Data](InputName=code_block_6.out0, Keys=code_block_6.out1, Values=code_block_6.out2)
code_block_7 = CodeBlock { "Select the Curtain Wall Element to Align Horizontal Grids to Levels:"; "Select Curtain Wall"; }
code_block_8 = CodeBlock { "Walls"; }
byName = Category.ByName(name=code_block_8)
code_block_9 = CodeBlock { true; }
ui_selectmodelelements_data = Custom[UI.SelectModelElements Data](InputName=code_block_7.out0, ButtonText=code_block_7.out1, CategoryFilter=byName, SelectSingleElement=code_block_9)  # package Data-Shapes; Creates a Revit element selection input for UI.MultipleInputForm++ . Check out www.data-shapes.net for more infos!
list_create = List.Create(item0=ui_textnote_data, item1=ui_textbox_data, item2=ui_dropdown_data, item3=ui_dropdown_data_2, item4=ui_selectmodelelements_data)
boolean = BoolSelector(true)
code_block_10 = CodeBlock { "https://go.gglo.com/Production/SitePages/Dynamo.aspx"; }
ui_multipleinputform = Custom[UI.MultipleInputForm ++](Description_optional=code_block, Logo_optional=file_path, ButtonText_optional=code_block_2.out0, Inputs=list_create, Toggle=boolean, LinkToHelp_optional=code_block_10, CancelButtonText_optional=code_block_2.out1)  # package Data-Shapes; Create a form with multiple inputs. see www.data-shapes.net for tutorials and infos!
code_block_11 = CodeBlock(x=ui_multipleinputform.User_Inputs) { x[0]; x[1]; x[2]; x[3]; }

# group: FYI, Confirmation during Testing
getLocation = Element.GetLocation(element=code_block_11.out3)
startPoint = Curve.StartPoint(curve=getLocation)

# group: Get CurtainGridLine Full Curves and Start Points
# note: Custom Node: Rhythmv.2023.9.1
ʳʰʸᵗʰᵐ_curtaingrid_bywallelement = Rhythm.Revit.Elements.CurtainGrid.ByWallElement(curtainWall=code_block_11.out3)
ʳʰʸᵗʰᵐ_curtaingridline_fullcurve = Rhythm.Revit.Elements.CurtainGridLine.FullCurve(curtainGridLine=ʳʰʸᵗʰᵐ_curtaingrid_bywallelement.uGrids)
startPoint_2 = Curve.StartPoint(curve=ʳʰʸᵗʰᵐ_curtaingridline_fullcurve)

code_block_12 = CodeBlock(x=ʳʰʸᵗʰᵐ_curtaingrid_bywallelement.uGrids) { x; }
code_block_13 = CodeBlock(x=code_block_11.out2) { x; }

# group: Collect All Levels in Project
code_block_14 = CodeBlock { "Levels"; }
byName_2 = Category.ByName(name=code_block_14)
all_elements_of_category = ElementsOfCategory(Category=byName_2)

code_block_15 = CodeBlock { ","; }
split = String.Split(string=code_block_11.out0, separator0=code_block_15)

# group: Test if Name String Contains or Starts with the User Input Keyword or Prefix
name = Element.Name(element=all_elements_of_category)
contains = String.Contains(string=name, searchFor=split@L1)
startsWith = String.StartsWith(string=name, searchFor=split@L1)
list_create_2 = List.Create(item0=contains, item1=startsWith)
getItemAtIndex = List.GetItemAtIndex(list=list_create_2@L4, index=code_block_11.out1)

filterByBoolMask = List.FilterByBoolMask(list=all_elements_of_category, mask=getItemAtIndex@L2)

# group: Sort Levels by Elevation
flatten = List.Flatten(list=filterByBoolMask.in)
elevation = Level.Elevation(level=flatten)
sortByKey = List.SortByKey(list=flatten, keys=elevation)

# group: Get Base Constraint of Selection
code_block_16 = CodeBlock { "Base Constraint"; }
getParameterValueByName = Element.GetParameterValueByName(element=code_block_11.out3, parameterName=code_block_16)

# group: Select Levels above Base Constraint of Selected Curtain Wall
# note: Custom Node: Clockwork
plane = Custom[Level.Plane](level=sortByKey.sortedList)  # package Clockwork for Dynamo 2.x; Retrieves the plane of a given level
# note: Custom Node: WombatDynamov.2.3.5
deconstruct = WombatDynamo.Plane.Deconstruct(plane=plane)
id = Element.Id(element=getParameterValueByName)
code_block_17 = CodeBlock(x=sortByKey.sortedList) { x; }
id_2 = Element.Id(element=code_block_17)
eq = id == id_2
code_block_18 = CodeBlock { true; }
firstIndexOf = List.FirstIndexOf(list=eq, item=code_block_18)
code_block_19 = CodeBlock(x=firstIndexOf) { x+1; }
dropItems = List.DropItems(list=deconstruct.O, amount=code_block_19)
deconstruct_2 = WombatDynamo.Point.Deconstruct(point=dropItems)

# group: Determine PBP Elevation
# note: Custom Node: GeniusLociv.2023.7.13
get_project_locations = Custom[Get Project Locations]()  # package Genius Loci; Works only in Revit 2018 and later. Retrieves the project positions of the given document in the Survey Coordinate System. (Coordinates of Internal origin, project base point and survey point)
code_block_20 = CodeBlock(x=get_project_locations.Project_Base_Point) { x[0]; }
# note: Custom Node: WombatDynamov.2.3.5
deconstruct_3 = WombatDynamo.Point.Deconstruct(point=code_block_20)

# group: Add PBP Elevation to Z Value of CurtainGridLine
# note: Custom Node: WombatDynamov.2.3.5
deconstruct_4 = WombatDynamo.Point.Deconstruct(point=startPoint_2)
code_block_21 = CodeBlock(x=deconstruct_4.Z, y=deconstruct_3.Z) { x+y; }
code_block_22 = CodeBlock { 1; }
round = Math.Round(number=code_block_21, digits=code_block_22)

# group: Pick Imperial or Metric Values Per User Input
convert_by_units = DynamoUnitConvert(deconstruct_2.Z, MeasurementType="autodesk.unit.quantity:length-1.0.4", FromConversion="autodesk.unit.unit:millimeters-1.0.1", ToConversion="autodesk.unit.unit:feet-1.0.1")
if_ = RefactoredIf(test=code_block_13, true=convert_by_units, false=deconstruct_2.Z)
convert_by_units_2 = DynamoUnitConvert(round, MeasurementType="autodesk.unit.quantity:length-1.0.4", FromConversion="autodesk.unit.unit:millimeters-1.0.1", ToConversion="autodesk.unit.unit:feet-1.0.1")
if_2 = RefactoredIf(test=code_block_13, true=convert_by_units_2, false=round)

# group: Create Points
byCoordinates = Point.ByCoordinates(x=deconstruct_4.X, y=deconstruct_4.Y, z=if_)
byCoordinates_2 = Point.ByCoordinates(x=deconstruct_4.X, y=deconstruct_4.Y, z=if_2)

# group: MAGIC
python_script = Python(IN[0]=ʳʰʸᵗʰᵐ_curtaingrid_bywallelement.uGrids, IN[1]=byCoordinates, IN[2]=byCoordinates_2)  # CPython3
# ---------- python_script.python (54 lines) ----------
import clr

clr.AddReference('RevitAPI')
from Autodesk.Revit.DB import *
from Autodesk.Revit.DB.Structure import *

clr.AddReference('RevitAPIUI')
from Autodesk.Revit.UI import *

clr.AddReference('System')
from System.Collections.Generic import List

clr.AddReference('RevitNodes')
import Revit
clr.ImportExtensions(Revit.GeometryConversion)
clr.ImportExtensions(Revit.Elements)

clr.AddReference('RevitServices')
from RevitServices.Persistence import DocumentManager
from RevitServices.Transactions import TransactionManager

clr.AddReference('ProtoGeometry')
from Autodesk.DesignScript.Geometry import *

doc = DocumentManager.Instance.CurrentDBDocument
uidoc=DocumentManager.Instance.CurrentUIApplication.ActiveUIDocument

# The inputs to this node will be stored as a list in the IN variables.
uGrids = UnwrapElement(IN[0])
newPts = IN[1]
startPtXYZ = IN[2]
crv = []
vec = []
n = 0
e = []

# Place your code below this line

for ug in uGrids:
        crv.append(ug.FullCurve.ToProtoType())
        vec.append(Vector.ByTwoPoints(startPtXYZ[n], newPts[n]))
        try:
                TransactionManager.Instance.EnsureInTransaction(doc)
                ug.Location.Move(vec[n].ToRevitType())
                TransactionManager.Instance.TransactionTaskDone()
        except:
                e.append(Exception)
        n += 1
        if n > len(startPtXYZ):
                break
        else:
                continue
# Assign your output to the OUT variable.
OUT = crv, startPtXYZ, newPts, e, vec
# ----------------------------------------

code_block_23 = CodeBlock(x=code_block_11.out0) { x; }
