# Dynamo graph script.dyn "Copy_RoomData2AreaData" (Dynamo 2.18.1.5096)
# packages: archi-lab.net 2024.217.1024, Clockwork for Dynamo 2.x 2.6.0, Data-Shapes 2023.2.112, spring nodes 210.1.1, WombatDynamo 2.3.5, Ampersand 2022.1.25

# group: WIP
# note: "Work in Progress"

# group: Design
# note: For List Management \ Back-End Functionality

# group: Annotation
# note: For Comments

# group: Info
# note: Good to know stuff

# group: Annotation
# note: For notes and titles

# group: Change / Output
# note: For changes made to Revit or Other App

# group: Control
# note: For sliders and other options

# group: User Input
# note: For selection and whatnot

# group: Background
# note: For workflow

# group: REQUIRED PACKAGES
# note: archilab | v.2023.213
# Clockwork | v.2.4.0
# Data-Shapes | v.2022.2.103
# spring nodes | v.210.1.1
# WombatDynamo | v.2.3.5
# Ampersand | v.2022.1.25

# group: REVIT PROJECT REPORT
# note: CREATED BY: Ren Rainville
# CREATED: 07/2019
# VERSION <2.2>
# LAST EDITED: 11/15/2023
# DYNAMO VERSION: <Dynamo 2.18>
# NOTES:
# Upon Users Selection of the Area Plans to copy room data into (based on View Template Naming 'Plan_Area_...' this process will copy the Room Name and Number to the Areas placed in the respective views assigned to the chosen View Template.

# group: Get All Area Plans, Clear Out Nulls
code_block = CodeBlock { "AreaPlan"; }
# note: Custom Node: archilab
getByType = archilab.Revit.Views.Views.GetByType(viewType=code_block)
viewTemplate = archilab.Revit.Views.Views.ViewTemplate(view=getByType)
isNull = Object.IsNull(object=viewTemplate)
filterByBoolMask = List.FilterByBoolMask(list=getByType, mask=isNull)

# note: Custom Node: archilab
viewTemplate_2 = archilab.Revit.Views.Views.ViewTemplate(view=filterByBoolMask.out)

# group: User Input for Selection of Area Plan Type
code_block_2 = CodeBlock { "Select Area Type"; "Engage"; "ABORT!"; }
file_path = Filename("F:\Operations\Marketing\Brand Materials\Logo\GGLO_logo_black.png")
code_block_3 = CodeBlock()
# ---------- code_block_3.designscript (2 lines) ----------
"Tool Tip";
"This Tool allows a user to select a specific Area Type to run this process. The process will copy room name and number into the related parameters of the area at the same location.";
# ----------------------------------------
# note: Custom Node: Data-Shapesv.2023.2.112
ui_textnote_data = Custom[UI.TextNote Data](Title=code_block_3.out0, TextNote=code_block_3.out1)  # package Data-Shapes; Create Data for TextNote input in UI.MultipleInputForm ++ . Check out www.data-shapes.net for more informations
code_block_4 = CodeBlock { "Pick Type of Area"; }
# note: Custom Node: Clockwork
name = Custom[Element.Name+](element=viewTemplate_2)  # package Clockwork for Dynamo 2.x; Gets an element's name. Unlike the OOTB node, this node should work for *all* Revit elements that have names and will also return the localized names of system parameters, parameter groups, display unit types, parameter types, unit symbol types, unit types and ForgeTypeIds.
uniqueItems = List.UniqueItems(list=name)
code_block_5 = CodeBlock { "Plan_Area_"; }
length = String.Length(string=code_block_5)
python_script = Python(IN[0]=uniqueItems, IN[1]=length)  # CPython3
# ---------- python_script.python (16 lines) ----------
# Load the Python Standard and DesignScript Libraries
import sys
import clr
clr.AddReference('ProtoGeometry')
from Autodesk.DesignScript.Geometry import *

# The inputs to this node will be stored as a list in the IN variables.
dataEnteringNode = IN
name = IN[0]
c = IN[1]
newName = []
# Place your code below this line
for n in name:
    newName.append(n[c:])
# Assign your output to the OUT variable.
OUT = newName
# ----------------------------------------
uniqueItems_2 = List.UniqueItems(list=viewTemplate_2)
ui_dropdown_data = Custom[UI.DropDown Data](InputName=code_block_4, Keys=python_script, Values=uniqueItems_2)  # package Data-Shapes; Create data for DropDown input in UI.MultiInputForm ++ . Check out www.data-shapes.net for more infos.
list_create = List.Create(item0=ui_textnote_data, item1=ui_dropdown_data)
boolean = BoolSelector(true)
code_block_6 = CodeBlock { "https://go.gglo.com/Production/SitePages/Dynamo.aspx"; }
ui_multipleinputform = Custom[UI.MultipleInputForm ++](Description_optional=code_block_2.out0, Logo_optional=file_path, ButtonText_optional=code_block_2.out1, Inputs=list_create, Toggle=boolean, LinkToHelp_optional=code_block_6, CancelButtonText_optional=code_block_2.out2)  # package Data-Shapes; Create a form with multiple inputs. see www.data-shapes.net for tutorials and infos!
view_template_of_area_views = CodeBlock(x=ui_multipleinputform.User_Inputs) { x; }

# group: Get Area Plans that Relate to the Area Plan Type Selected
allIndicesOf = List.AllIndicesOf(list=viewTemplate_2, item=view_template_of_area_views)
getItemAtIndex = List.GetItemAtIndex(list=filterByBoolMask.out, index=allIndicesOf)

# group: Collect Rooms by Level
flatten = List.Flatten(list=getItemAtIndex)
code_block_7 = CodeBlock { "Associated Level"; }
getParameterValueByName = Element.GetParameterValueByName(element=flatten, parameterName=code_block_7)
# note: Custom Node: WombatDynamov.2.3.5
byName = WombatDynamo.Level.ByName(name=getParameterValueByName)
code_block_8 = CodeBlock { true; }
# note: Custom Node: archilab
get_rooms_by_level = Custom[Get Rooms by Level](level=byName@L1, excludeUnplaced=code_block_8)  # package archi-lab.net; Filters Rooms by level.

# group: Collect Areas from Views
code_block_9 = CodeBlock { "Areas"; }
byName_2 = Category.ByName(name=code_block_9)
# note: Custom Node: spring nodesv.210.1.1
ꟿ_collect_elementsinview = Custom[ꟿ Collect.ElementsInView](view=getItemAtIndex, category=byName_2)  # package spring nodes; Selects all elements visible in the input view.

# group: Sort Rooms and Areas per Level
flatten_2 = List.Flatten(list=get_rooms_by_level.room)
# note: Custom Node: Clockwork
level = Custom[Element.Level](element=get_rooms_by_level.room@L2)  # package Clockwork for Dynamo 2.x; Gets an element's level
flatten_3 = List.Flatten(list=level)
code_block_10 = CodeBlock(l=flatten_3) { l.Name; }
sortByKey = List.SortByKey(list=flatten_2, keys=code_block_10)
level_2 = Custom[Element.Level](element=sortByKey.sortedList@L2)
flatten_4 = List.Flatten(list=ꟿ_collect_elementsinview)
level_3 = Custom[Element.Level](element=ꟿ_collect_elementsinview@L2)
flatten_5 = List.Flatten(list=level_3)
code_block_11 = CodeBlock(l=flatten_5) { l.Name; }
sortByKey_2 = List.SortByKey(list=flatten_4, keys=code_block_11)
level_4 = Custom[Element.Level](element=sortByKey_2.sortedList@L2)
# note: Custom Node: Ampersandv.2022.1.25
list_groupbykey = Custom[[&] List.GroupByKey](objectList=sortByKey_2.sortedList@L2, keys=sortByKey_2.sortedKeys@L2)  # package Ampersand; Sort the items of a list into groups (sublists) based on the corresponding items of a reference list. Example: The list {A,B,C,D,E} with the reference list {1,anyWord,4,anyWord,1} will be grouped into lists as { {A,E}, {B,D}, {C} } and the unique references will be {1, anyWord, 4}.
list_groupbykey_2 = Custom[[&] List.GroupByKey](objectList=sortByKey.sortedList@L2, keys=sortByKey.sortedKeys@L2)

# group: Find Any Areas on Levels without Rooms
eq = list_groupbykey.unique_keys@L1 == list_groupbykey_2.unique_keys@L1  # lacing=CrossProduct
# note: Custom Node: Clockwork
anyTrue = Custom[Booleans.AnyTrue](seq=eq)  # package Clockwork for Dynamo 2.x; Returns true if any item in a list of booleans is true. ATTENTION: This node will be deprecated in 2024. As of Revit 2022, please switch to the OOTB node AnyTrue.

# group: Filter Out Areas on Levels without Rooms
code_block_12 = CodeBlock { 1; }
flatten_6 = List.Flatten(list=list_groupbykey.groups, amount=code_block_12)
filterByBoolMask_2 = List.FilterByBoolMask(list=flatten_6, mask=anyTrue)

# group: Get Area Location (Filter out Areas on Levels without Rooms)
getLocation = Element.GetLocation(element=list_groupbykey.groups@L2)
filterByBoolMask_3 = List.FilterByBoolMask(list=getLocation, mask=anyTrue)

# group: Rooms, Area Locations, Areas
area_element_groups = CodeBlock(x=filterByBoolMask_2.in) { x; }
area_location_points = CodeBlock(x=filterByBoolMask_3.in) { x; }
room_element_groups = CodeBlock(x=list_groupbykey_2.groups) { x; }

flatten_7 = List.Flatten(list=area_element_groups)

# group: Test if Area Location is w/in Room Bounding Box
isInsideRoom = Room.IsInsideRoom(room=list_groupbykey_2.groups@@L2, point=area_location_points@L1, lacing=CrossProduct)

# group: Prepare Area List for Selection
# note: Custom Node: Clockwork
anyTrue_2 = Custom[Booleans.AnyTrue](seq=isInsideRoom@@L2)
count = List.Count(list=anyTrue_2)
ofRepeatedItem = List.OfRepeatedItem(item=flatten_7, amount=count)

code_block_13 = CodeBlock { true; }
allIndicesOf_2 = List.AllIndicesOf(list=isInsideRoom@@L2, item=code_block_13)

# group: Get Indices of Each List where Areas are within Room Bounding Boxes
isEmpty = List.IsEmpty(list=allIndicesOf_2@@L2)
code_block_14 = CodeBlock { false; }
allIndicesOf_3 = List.AllIndicesOf(list=isEmpty@L2, item=code_block_14)

code_block_15 = CodeBlock { 1; }
flatten_8 = List.Flatten(list=room_element_groups, amount=code_block_15)

# group: Format and Cull Indicies (some lists had double rooms, only took first room, this may need to be reviewed for accuracy)
flatten_9 = List.Flatten(list=allIndicesOf_2@@L2)
firstItem = List.FirstItem(list=flatten_9@L2)
count_2 = List.Count(list=flatten_9@L3)
chop = List.Chop(list=firstItem, lengths=count_2)
# note: Custom Node: archilab
clear_list = Custom[Clear List](input=chop)  # package archi-lab.net; This node will remove all Null and Empty Lists from any list.

# group: Select Rooms and Areas that are Coincident
getItemAtIndex_2 = List.GetItemAtIndex(list=ofRepeatedItem, index=allIndicesOf_3@L2)
flatten_10 = List.Flatten(list=getItemAtIndex_2)
getItemAtIndex_3 = List.GetItemAtIndex(list=flatten_8@L2, index=clear_list@L2)
flatten_11 = List.Flatten(list=getItemAtIndex_3)

# group: Get Room Parameter Values
code_block_16 = CodeBlock()
# ---------- code_block_16.designscript (2 lines) ----------
["Number",
"Name"];
# ----------------------------------------
getParameterValueByName_2 = Element.GetParameterValueByName(element=flatten_11@L2, parameterName=code_block_16, lacing=Longest)
transpose = List.Transpose(lists=getParameterValueByName_2)

# group: Set Area Parameters with Room Data
code_block_17 = CodeBlock()  # same code as code_block_16
count_3 = List.Count(list=transpose)
ofRepeatedItem_2 = List.OfRepeatedItem(item=code_block_17, amount=count_3)
setParameterByName = Element.SetParameterByName(element=flatten_10, parameterName=ofRepeatedItem_2, value=transpose)

# group: Dynamo Player Output
count_4 = List.Count(list=setParameterByName@L3)
count_5 = List.Count(list=ofRepeatedItem@L2)
eq_2 = count_4 == count_5
code_block_18 = CodeBlock { "Success"; "Something is off"; }
if_ = RefactoredIf(test=eq_2, true=code_block_18.out0, false=code_block_18.out1)
watch = Watch(if_)  # graph output
