# Dynamo graph script.dyn "Create_CurtainWallGrids-PerList" (Dynamo 2.18.1.5096)
# packages: Rhythm 2023.9.1, Data-Shapes 2023.2.112, archi-lab.net 2024.217.1024

# group: WIP
# note: "Work in Progress"

# group: Design
# note: For List Management \ Back-End Functionality

# group: Annotation
# note: For Comments

# group: Info
# note: Good to know stuff

# group: Annotation
# note: For notes and titles

# group: Change / Output
# note: For changes made to Revit or Other App

# group: Control
# note: For sliders and other options

# group: User Input
# note: For selection and whatnot

# group: Background
# note: For workflow

# group: REQUIRED PACKAGES
# note: Rhythm | v.2023.9.1
# Data-Shapes | v.2023.2.112
# archilab |

# group: REVIT PROJECT REPORT
# note: CREATED BY: Ren Rainville
# CREATED: 11/2019
# VERSION <1.2>
# LAST EDITED: 11/15/2023
# DYNAMO VERSION: <Dynamo 2.18>
# NOTES:
# This tool allows for the creation of Horizontal curtain wall grid lines based on a repeating pattern in the base units of a project file. It will ask the user if the project is Imperial or Metric in order to properly set the elevations of the grids.

# group: MultipleInputFormUI++ (Asks User for Input Data to Run)
code_block = CodeBlock { "Create Curtain Wall Grids"; }
file_path = Filename("H:\Dynamo\General\GGLO_logo_black.png")
code_block_2 = CodeBlock { "Engage"; "ABORT!"; }
code_block_3 = CodeBlock()
# ---------- code_block_3.designscript (2 lines) ----------
"Tool Tip";
"This Tool will allow the user to select a curtain wall element and create vertical or horizontal grids per a list of distance values (this can be a repeating pattern). The distances are noted in a COMA SEPARATED LIST without Spaces (#,###,##,##.#,#)in the base unit of the file.";
# ----------------------------------------
# note: Custom Node: Data-Shapesv.2023.2.112
ui_textnote_data = Custom[UI.TextNote Data](Title=code_block_3.out0, TextNote=code_block_3.out1)  # package Data-Shapes; Create Data for TextNote input in UI.MultipleInputForm ++ . Check out www.data-shapes.net for more informations
code_block_4 = CodeBlock { "Select Project Units (Imperial / Metric):"; ["Imperial","Metric"]; [0,1]; }
ui_dropdown_data = Custom[UI.DropDown Data](InputName=code_block_4.out0, Keys=code_block_4.out1, Values=code_block_4.out2)  # package Data-Shapes; Create data for DropDown input in UI.MultiInputForm ++ . Check out www.data-shapes.net for more infos.
code_block_5 = CodeBlock { "Select the Curtain Wall Element to Create Grids:"; "Select Curtain Wall"; }
code_block_6 = CodeBlock { "Walls"; }
byName = Category.ByName(name=code_block_6)
code_block_7 = CodeBlock { true; }
ui_selectmodelelements_data = Custom[UI.SelectModelElements Data](InputName=code_block_5.out0, ButtonText=code_block_5.out1, CategoryFilter=byName, SelectSingleElement=code_block_7)  # package Data-Shapes; Creates a Revit element selection input for UI.MultipleInputForm++ . Check out www.data-shapes.net for more infos!
code_block_8 = CodeBlock()
# ---------- code_block_8.designscript (2 lines) ----------
"Provide the pattern for Vertical Spacing (Base Project Units) [Make sure to separate numbers with a Coma and without spaces]";
"#,#,#,#";
# ----------------------------------------
ui_textbox_data = Custom[UI.TextBox Data](InputName=code_block_8.out0, DefaultText=code_block_8.out1)  # package Data-Shapes; Create Data for TextBox input in UI.MultipleInputForm ++ . Check out www.data-shapes.net for more informations
code_block_9 = CodeBlock { "Select Horizontal or Vertical Grids"; ["Vertical","Horizontal"]; [0,1]; 1; }
ui_radiobuttons_data = Custom[UI.RadioButtons Data](InputName=code_block_9.out0, Keys=code_block_9.out1, Values=code_block_9.out2, DefaultValueIndex=code_block_9.out3)  # package Data-Shapes; Create radio buttons input for UI.MultipleInputForm ++ .
list_create = List.Create(item0=ui_textnote_data, item1=ui_dropdown_data, item2=ui_selectmodelelements_data, item3=ui_textbox_data, item4=ui_radiobuttons_data)
boolean = BoolSelector(true)
code_block_10 = CodeBlock { "https://go.gglo.com/Production/SitePages/Dynamo.aspx"; }
code_block_11 = CodeBlock { 450; }
ui_multipleinputform = Custom[UI.MultipleInputForm ++](Description_optional=code_block, Logo_optional=file_path, ButtonText_optional=code_block_2.out0, Inputs=list_create, Toggle=boolean, LinkToHelp_optional=code_block_10, CancelButtonText_optional=code_block_2.out1, Width_optional=code_block_11)  # package Data-Shapes; Create a form with multiple inputs. see www.data-shapes.net for tutorials and infos!
code_block_12 = CodeBlock(x=ui_multipleinputform.User_Inputs) { x[0]; x[1]; x[2]; x[3]; }

# group: Get Curtain Wall Grid and Location
# note: Custom Node: Rhythmv.2023.9.1
ʳʰʸᵗʰᵐ_curtaingrid_bywallelement = Rhythm.Revit.Elements.CurtainGrid.ByWallElement(curtainWall=code_block_12.out1)
getLocation = Element.GetLocation(element=code_block_12.out1)

# group: Get Curtain Wall Height & Base Offset
code_block_13 = CodeBlock()
# ---------- code_block_13.designscript (2 lines) ----------
["Unconnected Height",
"Base Offset"];
# ----------------------------------------
getParameterValueByName = Element.GetParameterValueByName(element=code_block_12.out1, parameterName=code_block_13)
code_block_14 = CodeBlock(x=getParameterValueByName) { x[0]; x[1]; }

# group: Create Curve from Bottom to Top (Horiz Grids)
startPoint = Curve.StartPoint(curve=getLocation)
code_block_15 = CodeBlock(pnt=startPoint) { pnt.X; pnt.Y; pnt.Z; }
code_block_16 = CodeBlock(x=code_block_15.out2, y=code_block_14.out1) { x+y; }
byCoordinates = Point.ByCoordinates(x=code_block_15.out0, y=code_block_15.out1, z=code_block_16)
code_block_17 = CodeBlock(x=code_block_16, y=code_block_14.out0) { x+y; }
byCoordinates_2 = Point.ByCoordinates(x=code_block_15.out0, y=code_block_15.out1, z=code_block_17)
byStartPointEndPoint = Line.ByStartPointEndPoint(startPoint=byCoordinates, endPoint=byCoordinates_2)

# group: Create Curve from Start to End (Vert Grids)
startPoint_2 = Curve.StartPoint(curve=getLocation)
code_block_18 = CodeBlock(pnt=startPoint_2) { pnt.X; pnt.Y; pnt.Z; }
code_block_19 = CodeBlock(x=code_block_18.out2, y=code_block_14.out1) { x+y; }
byCoordinates_3 = Point.ByCoordinates(x=code_block_18.out0, y=code_block_18.out1, z=code_block_19)
endPoint = Curve.EndPoint(curve=getLocation)
code_block_20 = CodeBlock(pnt=endPoint) { pnt.X; pnt.Y; pnt.Z; }
byCoordinates_4 = Point.ByCoordinates(x=code_block_20.out0, y=code_block_20.out1, z=code_block_19)
byStartPointEndPoint_2 = Line.ByStartPointEndPoint(startPoint=byCoordinates_3, endPoint=byCoordinates_4)

# group: Horiz (T) or Vert (F)
if_ = RefactoredIf(test=code_block_12.out3, true=byStartPointEndPoint, false=byStartPointEndPoint_2)
length = Curve.Length(curve=byStartPointEndPoint_2)
if_2 = RefactoredIf(test=code_block_12.out3, true=code_block_17, false=length)

# group: Background (turn string into list of numbers)
code_block_21 = CodeBlock { ","; }
split = String.Split(string=code_block_12.out2, separator0=code_block_21)
trimWhitespace = String.TrimWhitespace(string=split)
toNumber = String.ToNumber(string=trimWhitespace)

# group: Background - Create repeated pattern list to length / height of wall
# note: Custom Node: archilab
mass_addition = Custom[Mass Addition](list=toNumber)  # package archi-lab.net; This node will attempt to sum all elements contained within it.
code_block_22 = CodeBlock(x=if_2, y=mass_addition) { DSCore.Math.Round(x/y); }
ofRepeatedItem = List.OfRepeatedItem(item=toNumber, amount=code_block_22)
flatten = List.Flatten(list=ofRepeatedItem)
mass_addition_partials_from = Python(IN[0]=flatten)  # "Mass Addition Partials (from Lunchbox)"; CPython3
# ---------- mass_addition_partials_from.python (19 lines) ----------
#Copyright(c) 2014, Nathan Miller
# The Proving Ground, http://theprovingground.org
import clr
clr.AddReference('ProtoGeometry')
from Autodesk.DesignScript.Geometry import *

#The input to this node will be stored in the IN[0] variable.
list = IN[0]
mass = 0
masspart = []
if hasattr(list, "__iter__"):
    for i in range(0,len(list)):
        mass = mass + list[i]
        masspart.append(mass)
else:
    masspart.append(list)

#Assign your output to the OUT variable
OUT = masspart
# ----------------------------------------

# group: Removes Values Outside of Wall Domain
ge = mass_addition_partials_from >= if_2
filterByBoolMask = List.FilterByBoolMask(list=mass_addition_partials_from, mask=ge)

pointAtSegmentLength = Curve.PointAtSegmentLength(curve=if_, segmentLength=filterByBoolMask.out)

# group: Add PBP Elevation to Z Value of CurtainGridLine
code_block_23 = CodeBlock(pnt=pointAtSegmentLength) { pnt.X; pnt.Y; pnt.Z; }

# group: Background - Pick Imperial or Metric Values Per User Input
convert_by_units = DynamoUnitConvert(code_block_23.out2, MeasurementType="autodesk.unit.quantity:length-1.0.4", FromConversion="autodesk.unit.unit:millimeters-1.0.1", ToConversion="autodesk.unit.unit:feet-1.0.1")
if_3 = RefactoredIf(test=code_block_12.out0, true=convert_by_units, false=code_block_23.out2)

# group (continued): Add PBP Elevation to Z Value of CurtainGridLine
byCoordinates_5 = Point.ByCoordinates(x=code_block_23.out0, y=code_block_23.out1, z=if_3)

# group: To Revit
# note: Custom Node: Rhythmv.2023.9.1
ʳʰʸᵗʰᵐ_curtaingrid = Rhythm.Revit.Elements.CurtainGrid.AddGridLineByPoint(curtainGrid=ʳʰʸᵗʰᵐ_curtaingrid_bywallelement.curtainGrid, locationPoint=byCoordinates_5, isUGridline=code_block_12.out3)

# group: Dynamo Player Output
name = Element.Name(element=ʳʰʸᵗʰᵐ_curtaingrid)
code_block_24 = CodeBlock { "CurtainGrid"; }
contains = String.Contains(string=name, searchFor=code_block_24)
flatten_2 = List.Flatten(list=contains)
anyTrue = List.AnyTrue(list=flatten_2)
code_block_25 = CodeBlock { "Success"; "Something went wrong"; }
if_4 = RefactoredIf(test=anyTrue, true=code_block_25.out0, false=code_block_25.out1)
watch = Watch(if_4)  # graph output
