# Dynamo graph script.dyn "Create_LevelsByOffset" (Dynamo 2.18.1.5096)
# packages: Data-Shapes 2023.2.112, Clockwork for Dynamo 2.x 2.6.0, spring nodes 210.1.1, LunchBox for Dynamo 2018.7.6, Rhythm 2023.9.1, WombatDynamo 2.3.5

# group: WIP
# note: "Work in Progress"

# group: Design
# note: For List Management \ Back-End Functionality

# group: Annotation
# note: For Comments

# group: Info
# note: Good to know stuff

# group: Annotation
# note: For notes and titles

# group: Change / Output
# note: For changes made to Revit or Other App

# group: Control
# note: For sliders and other options

# group: User Input
# note: For selection and whatnot

# group: Background
# note: For workflow

# group: REQUIRED PACKAGES
# note: Data-Shapes | v.2023.2.112
# Clockwork | v.2.4.0
# spring nodes | v.210.1.1
# LunchBox | v.2018.7.6
# Rhythm | v.2023.9.1
# WombatDynamo | v.2.3.5

# group: REVIT PROJECT REPORT
# note: CREATED BY: Ren Rainville
# CREATED: 09/2019
# VERSION <1.4>
# LAST EDITED: 11/16/2023
# DYNAMO VERSION: <Dynamo 2.18>
# NOTES:
# This process allows a team to add levels above the highest level in the project. No matter if it is Level 1 or Level 100.

# group: Repeated Inputs / Values
file_path = Filename("..\General\GGLO_logo_black.png")
code_block = CodeBlock { "Engage"; "ABORT!"; }
code_block_2 = CodeBlock()
# ---------- code_block_2.designscript (2 lines) ----------
"Tool Tip";
"This Tool allows a user to create levels (above the current highest Level) with a typical offset height or a list of varying heights.";
# ----------------------------------------
# note: Custom Node: Data-Shapesv.2023.2.112
ui_textnote_data = Custom[UI.TextNote Data](Title=code_block_2.out0, TextNote=code_block_2.out1)  # package Data-Shapes; Create Data for TextNote input in UI.MultipleInputForm ++ . Check out www.data-shapes.net for more informations
code_block_3 = CodeBlock { "https://go.gglo.com/Production/SitePages/Dynamo.aspx"; }

# group: Create Dialog Box Prompting User to Input # of Levels and Offset Distance
code_block_4 = CodeBlock { "Create Levels Above Highest Level in Project"; }
code_block_5 = CodeBlock { "Enter # of Levels Desired"; }
# note: Custom Node: Data-Shapesv.2023.2.112
ui_textbox_data = Custom[UI.TextBox Data](InputName=code_block_5)  # package Data-Shapes; Create Data for TextBox input in UI.MultipleInputForm ++ . Check out www.data-shapes.net for more informations
code_block_6 = CodeBlock()
# ---------- code_block_6.designscript (4 lines) ----------
"Select Option of Creating Level Offset";
["Level Offset by List",
"Level Offset by Same Value"];
[true,false];
# ----------------------------------------
ui_radiobuttons_data = Custom[UI.RadioButtons Data](InputName=code_block_6.out0, Keys=code_block_6.out1, Values=code_block_6.out2)  # package Data-Shapes; Create radio buttons input for UI.MultipleInputForm ++ .
list_create = List.Create(item0=ui_textnote_data, item1=ui_textbox_data, item2=ui_radiobuttons_data)
boolean = BoolSelector(true)  # graph input
ui_multipleinputform = Custom[UI.MultipleInputForm ++](Description_optional=code_block_4, Logo_optional=file_path, ButtonText_optional=code_block.out0, Inputs=list_create, Toggle=boolean, LinkToHelp_optional=code_block_3, CancelButtonText_optional=code_block.out1)  # package Data-Shapes; Create a form with multiple inputs. see www.data-shapes.net for tutorials and infos!

code_block_7 = CodeBlock(x=ui_multipleinputform.User_Inputs) { x[0]; x[1]; }
code_block_8 = CodeBlock(x=file_path, y=code_block.out0, z=code_block.out1) { x; y; z; }

# group: Enter Level Offset (either List or repeated #)
code_block_9 = CodeBlock { "Set Level Offset Value(s)"; }
code_block_10 = CodeBlock()
# ---------- code_block_10.designscript (4 lines) ----------
"Type List of Offsets (Numbers ONLY) [Separated by Commas]";
"x,y.z,y,z,a";
"Type the typical Offset (In Decimal Feet) [to be Repeated]";
true;
# ----------------------------------------
# note: Custom Node: Data-Shapesv.2023.2.112
ui_textbox_data_2 = Custom[UI.TextBox Data](InputName=code_block_10.out0, DefaultText=code_block_10.out1)
ui_textbox_data_3 = Custom[UI.TextBox Data](InputName=code_block_10.out2, IsNumberEntry=code_block_10.out3)
if_ = If(test=code_block_7.out1, true=ui_textbox_data_2, false=ui_textbox_data_3)
list_create_2 = List.Create(item0=ui_textnote_data, item1=if_)
ui_multipleinputform_2 = Custom[UI.MultipleInputForm ++](Description_optional=code_block_9, Logo_optional=code_block_8.x, ButtonText_optional=code_block_8.y, Inputs=list_create_2, Toggle=boolean, LinkToHelp_optional=code_block_3, CancelButtonText_optional=code_block_8.z)

# group: Create List from Coma Separated String
code_block_11 = CodeBlock { ","; }
# note: Warning at this Node is OK
split = String.Split(string=ui_multipleinputform_2.User_Inputs, separator0=code_block_11)

# group: Gets all Levels, Finds Highest and Takes Number of that Level
code_block_12 = CodeBlock { "Level"; }
# note: Custom Node: Clockwork
byName = Custom[ElementType.ByName](name=code_block_12)  # package Clockwork for Dynamo 2.x; Retrieves an element class by its name - to be used with the OOTB node "All Elements of Class".
all_elements_of_type = Custom[All Elements of Type+](elementType=byName)  # package Clockwork for Dynamo 2.x; Gets all placed elements of a given element class in the model. Unlike the OOTB node, it supports collecting from linked models and has a (optional) SchemaGUID filter.
elevation = Level.Elevation(level=all_elements_of_type)
sortByKey = List.SortByKey(list=all_elements_of_type, keys=elevation)
count = List.Count(list=sortByKey.sortedList)
code_block_13 = CodeBlock(x=count) { x-1; }
getItemAtIndex = List.GetItemAtIndex(list=sortByKey.sortedList, index=code_block_13)
name = Level.Name(level=sortByKey.sortedList)
code_block_14 = CodeBlock { "LEVEL "; }
contains = String.Contains(string=name, searchFor=code_block_14)
filterByBoolMask = List.FilterByBoolMask(list=sortByKey.sortedList, mask=contains)
name_2 = Level.Name(level=filterByBoolMask.in)
count_2 = List.Count(list=filterByBoolMask.in)
code_block_15 = CodeBlock(x=count_2) { x-1; }
getItemAtIndex_2 = List.GetItemAtIndex(list=name_2, index=code_block_15)
explode = Custom[String.Explode](str=getItemAtIndex_2)  # package Clockwork for Dynamo 2.x; Chops up a string into a list of characters
length = String.Length(string=getItemAtIndex_2)
code_block_16 = CodeBlock(x=length) { [x-2,x-1]; }
getItemAtIndex_3 = List.GetItemAtIndex(list=explode, index=code_block_16)
code_block_17 = CodeBlock(x=getItemAtIndex_3) { x[0]; x[1]; }
concat = String.Concat(string0=code_block_17.out0, string1=code_block_17.out1)
toNumber = String.ToNumber(string=concat)

toNumber_2 = String.ToNumber(string=code_block_7.out0)

# group: Tests to Determine Next Step, another Dialog Box or Feed Output onto Next Step
if_2 = If(test=code_block_7.out1, true=split, false=ui_multipleinputform_2.User_Inputs)
count_3 = List.Count(list=split@L2)
code_block_18 = CodeBlock(x=count_3, y=toNumber_2) { x==y; }

# group: Repeats "Level" Based on # of Desired Levels
code_block_19 = CodeBlock { "LEVEL "; }
ofRepeatedItem = List.OfRepeatedItem(item=code_block_19, amount=toNumber_2)
flatten = List.Flatten(list=ofRepeatedItem)

# group: Creates Values for new Levels based on Highest Level in Project
code_block_20 = CodeBlock(x=toNumber, y=toNumber_2) { [x+1..x+y..1]; }
flatten_2 = List.Flatten(list=code_block_20)

string_from_object = FromObject(obj=flatten_2)

# group: Creates Level Name
create = List.Create(item0=flatten, item1=string_from_object)
transpose = List.Transpose(lists=create)
concat_2 = String.Concat(string0=transpose@L3)

code_block_21 = CodeBlock(x=file_path, y=code_block.out0, z=code_block.out1) { x; y; z; }

# group: User Input (Exception: If List Length does not Equal # of Levels to be created)
code_block_22 = CodeBlock { "Please Enter a List if Offsets that Equals the # of Levels Desired"; }
flatten_3 = List.Flatten(list=code_block_18)
code_block_23 = CodeBlock { false; true; }
code_block_24 = CodeBlock()
# ---------- code_block_24.designscript (4 lines) ----------
"Type List of Offsets [Separated by Comas]";
"x,y.z,y,z,a";
"Type the typical Offset (In Decimal Feet) [to be Repeated]";
true;
# ----------------------------------------
# note: Custom Node: Data-Shapesv.2023.2.112
ui_textbox_data_4 = Custom[UI.TextBox Data](InputName=code_block_24.out0, DefaultText=code_block_24.out1)
if_3 = If(test=flatten_3, true=code_block_23.out0, false=ui_textbox_data_4)
list_create_3 = List.Create(item0=ui_textnote_data, item1=if_3)
if_4 = If(test=code_block_7.out1, true=code_block_23.out1, false=code_block_23.out0)
if_5 = If(test=flatten_3, true=code_block_23.out0, false=if_4)
ui_multipleinputform_3 = Custom[UI.MultipleInputForm ++](Description_optional=code_block_22, Logo_optional=code_block_21.x, ButtonText_optional=code_block_21.y, Inputs=list_create_3, Toggle=if_5, LinkToHelp_optional=code_block_3, CancelButtonText_optional=code_block_21.z)
code_block_25 = CodeBlock { ","; }
split_2 = String.Split(string=ui_multipleinputform_3.User_Inputs, separator0=code_block_25)
flatten_4 = List.Flatten(list=split_2@L2)

toNumber_3 = String.ToNumber(string=flatten_4)
# note: Custom Node: LunchBox
lunchbox_mass_addition = Custom[LunchBox Mass Addition](numbers=toNumber_3)  # package LunchBox for Dynamo; Returns the total value of a list of numbers.

# group: Repeats Typ Offset Value by # of Desired Levels
ofRepeatedItem_2 = List.OfRepeatedItem(item=ui_multipleinputform_2.User_Inputs, amount=toNumber_2)
flatten_5 = List.Flatten(list=ofRepeatedItem_2)

# group: Select Values to Use for Offset
code_block_26 = CodeBlock { [true,false]; }
toNumber_4 = String.ToNumber(string=split)
# note: Custom Node: LunchBox
lunchbox_mass_addition_2 = Custom[LunchBox Mass Addition](numbers=toNumber_4)
flatten_6 = List.Flatten(list=lunchbox_mass_addition_2.Partials)
# note: Warning at this Node is OK
lunchbox_mass_addition_3 = Custom[LunchBox Mass Addition](numbers=flatten_5)
flatten_7 = List.Flatten(list=lunchbox_mass_addition_3.Partials)
list_create_4 = List.Create(item0=flatten_6, item1=flatten_7)
# note: Custom Node: spring nodesv.210.1.1
ꟿ_dictionary_bykeysvalues = Custom[ꟿ Dictionary.ByKeysValues](keys=code_block_26, values=list_create_4, searchKeys=code_block_7.out1)  # package spring nodes; Dictionaries are an incredibly powerful tool for making associative sets between two equal length lists. The first list must be of unique strings (or numbers) and will be the key and the second list will be the matching values (it can be made up of geometry, elements, even other lists) The search keys list will provide the corresponding value to the input key.
flatten_8 = List.Flatten(list=ꟿ_dictionary_bykeysvalues@L2)
list_create_5 = List.Create(item0=lunchbox_mass_addition.Partials, item1=flatten_8)
ꟿ_dictionary_bykeysvalues_2 = Custom[ꟿ Dictionary.ByKeysValues](keys=code_block_26, values=list_create_5, searchKeys=if_5)

# group: Creates Levels by Name and Offset
code_block_27 = CodeBlock(passthrough=getItemAtIndex, waitfor=concat_2) { [passthrough,waitfor][0]; }
byLevelOffsetAndName = Level.ByLevelOffsetAndName(level=code_block_27, offset=ꟿ_dictionary_bykeysvalues_2@L1, name=concat_2@L1)

# group: Create Floor Plan View and Set Level Workset to Shared Levels and Grids
byLevel = FloorPlanView.ByLevel(level=byLevelOffsetAndName)
code_block_28 = CodeBlock { "Workset"; }
code_block_29 = CodeBlock { "Shared Levels and Grids"; }
# note: Custom Node: WombatDynamov.2.3.5
byName_2 = WombatDynamo.Workset.ByName(name=code_block_29)
count_4 = List.Count(list=byLevelOffsetAndName)
ofRepeatedItem_3 = List.OfRepeatedItem(item=byName_2, amount=count_4)
id = WombatDynamo.Workset.Id(workset=ofRepeatedItem_3@L2)
# note: Custom Node: Rhythmv.2023.9.1
ʳʰʸᵗʰᵐ_elements = Rhythm.Revit.Elements.Elements.SetParameterByNameTypeOrInstance(element=byLevelOffsetAndName, parameterName=code_block_28, value=id@L2)

# group: Dynamo Player Output
code_block_30 = CodeBlock(e=ʳʰʸᵗʰᵐ_elements) { e.Name; }
code_block_31 = CodeBlock { "LEVEL"; }
contains_2 = String.Contains(string=code_block_30, searchFor=code_block_31)
countTrue = List.CountTrue(list=contains_2)
eq = countTrue == count_4
code_block_32 = CodeBlock { "Success"; "Something went wrong"; }
if_6 = RefactoredIf(test=eq, true=code_block_32.out0, false=code_block_32.out1)
watch = Watch(if_6)  # graph output
