# Dynamo graph script.dyn "Export_UpCodesRevitCSV" (Dynamo 2.18.1.5096)

# group: DIRECTIONS
# note: Script Name
# UpCodesRevitCSVExport
# note: Author/Creator
# UpCodes
# note: Dynamo Version
# 2.10+
# note: Description
# This dynamo script was created to help export information that Revit
# doesn't provide out of the box. It will attempt to export the following
# parameters for each space provided:
# - Story
# - Story Height
# - Space Name
# - Area
# - Occupancy
# - Occupants Egress To
# If these are not provided at all, they are not exported.
# The "Occupants Egress To" looks at the doors FromRoom and ToRoom parameters. We also attempt
# to flip the FromRoom and ToRoom if a door is going FROM a space with
# 'corridor' in the name to a space other than one with 'stair' in the name. NOTE: This is just a starting point as we can't determine which spaces are on an egress route. Make sure to update these based on your code requirements.

# group: INPUTS
directory_path = Directory("C:\")  # graph input
file_name = StringInput("UpCodes_Revit_CSV_Export")  # graph input
code_block = CodeBlock { "Rooms"; }
byName = Category.ByName(name=code_block)
all_elements_of_category = ElementsOfCategory(Category=byName)
include_story_height = BoolSelector(true)  # graph input
include_occupancy = BoolSelector(true)  # graph input
include_occupants_egress_to = BoolSelector(true)  # graph input

file_name_2 = CodeBlock(a=directory_path, b=file_name) { a + "/" + b + ".csv"; }
code_block_2 = CodeBlock()
# ---------- code_block_2.designscript (6 lines) ----------
["Story",
"Story Height",
"Space Name",
"Area",
"Occupancy",
"Occupants Egress To"];
# ----------------------------------------
code_block_3 = CodeBlock { "Level"; }
space_level = Element.GetParameterValueByName(element=all_elements_of_category, parameterName=code_block_3)
code_block_4 = CodeBlock { "Levels"; }
byName_2 = Category.ByName(name=code_block_4)
all_elements_of_category_2 = ElementsOfCategory(Category=byName_2)
level_heights_from_level_names = Python(IN[0]=all_elements_of_category_2, IN[1]=space_level)  # CPython3
# ---------- level_heights_from_level_names.python (20 lines) ----------
levels = IN[0]
level_names_from_spaces = IN[1]

levels = sorted(levels, key=lambda level: level.Elevation)

level_heights_by_name = {}
out_list = []

for idx, level in enumerate(levels):
	# This makes a big assumption that the level height is measured to the next 
	# available level
	if idx < len(levels) - 1:
		current_elevation = level.Elevation
		next_elevation = levels[idx + 1].Elevation
		level_heights_by_name[level.Name] = round(next_elevation - current_elevation)
		
for level_name in level_names_from_spaces:
	out_list.append(level_heights_by_name[level_name])

OUT = out_list
# ----------------------------------------
code_block_5 = CodeBlock { "Name"; }
space_name = Element.GetParameterValueByName(element=all_elements_of_category, parameterName=code_block_5)
code_block_6 = CodeBlock { "Number"; }
space_number = Element.GetParameterValueByName(element=all_elements_of_category, parameterName=code_block_6)
combine_name_and_number = CodeBlock(a=space_name, b=space_number) { a + " - " + b; }
code_block_7 = CodeBlock { "Area"; }
space_area = Element.GetParameterValueByName(element=all_elements_of_category, parameterName=code_block_7)
area = Math.Ceiling(number=space_area)
code_block_8 = CodeBlock { "Occupancy"; }
space_occupancy = Element.GetParameterValueByName(element=all_elements_of_category, parameterName=code_block_8)
code_block_9 = CodeBlock { "Doors"; }
byName_3 = Category.ByName(name=code_block_9)
all_elements_of_category_3 = ElementsOfCategory(Category=byName_3)
get_rooms_from_doors = Python(IN[0]=all_elements_of_category_3)  # CPython3
# ---------- get_rooms_from_doors.python (16 lines) ----------
def get_room_from_door(door):
	if hasattr(door, "FromRoom"):
		# Need to wrap this in try/except for doors/windows that don't exist in the given phase
		try: 
			return door.FromRoom, door.ToRoom
		except:
			return None, None
	else: 
	    return None, None

doors = UnwrapElement(IN[0])

if isinstance(IN[0], list): 
	OUT = map(list, zip(*[get_room_from_door(door) for door in doors]))
else: 
	OUT = get_room_from_door(doors, phase)
# ----------------------------------------
code_block_10 = CodeBlock(seq=get_rooms_from_doors) { seq[0]; seq[1]; }
room_exits = Python(IN[0]=all_elements_of_category, IN[1]=code_block_10.out0, IN[2]=code_block_10.out1)  # CPython3
# ---------- room_exits.python (24 lines) ----------
all_rooms = IN[0]
from_rooms = IN[1]
to_rooms = IN[2]

out_list = []
for room in all_rooms:
	room_list = []
	for from_room, to_room in zip(from_rooms, to_rooms):
	   temp_to_room = to_room
	   temp_from_room = from_room
	   if temp_to_room is not None and temp_from_room is not None:
	       # This makes a big assumption that the room should exit to 
	       # a corridor. It's possible that a room can have the door
	       # swinging in, but we always assume the room exits to a
	       # corridor, so we look for "corridor" in the name to determine
	       # if we should swap the rooms
	       if "corridor" in from_room.Name.lower() and "stair" not in to_room.Name.lower():
	           temp_to_room, temp_from_room = from_room, to_room
	   
	       if room.Id == temp_from_room.Id:
	           room_list.append(temp_to_room.Name + " - " + temp_to_room.Number)
	out_list.append(";".join(room_list))
		
OUT = out_list
# ----------------------------------------
list_create = List.Create(item0=space_level, item1=level_heights_from_level_names, item2=combine_name_and_number, item3=area, item4=space_occupancy, item5=room_exits)
byKeysValues = DesignScript.Builtin.Dictionary.ByKeysValues(keys=code_block_2, values=list_create)
remove_keys_and_return_list = Python(IN[0]=byKeysValues, IN[1]=include_story_height, IN[2]=include_occupancy, IN[3]=include_occupants_egress_to)  # CPython3
# ---------- remove_keys_and_return_list.python (15 lines) ----------
data = IN[0]
include_level_heights = IN[1]
include_occupancy = IN[2]
include_exits = IN[3]

if not include_level_heights:
	del data['Level Heights']
if not include_occupancy:
	del data['Occupancy']
if not include_exits:
	del data['Exits']

out_list = [values for key, values in data.items()]

OUT = out_list
# ----------------------------------------
code_block_11 = CodeBlock { ""; }
eq = remove_keys_and_return_list@@L1 == code_block_11
list_has_all_empty_values = List.AllTrue(list=eq@L2)
filterByBoolMask = List.FilterByBoolMask(list=code_block_2, mask=list_has_all_empty_values)
filterByBoolMask_2 = List.FilterByBoolMask(list=list_create, mask=list_has_all_empty_values)
transpose = List.Transpose(lists=filterByBoolMask_2.out)
addItemToFront = List.AddItemToFront(item=filterByBoolMask.out, list=transpose)
exportCSV = Data.ExportCSV(filePath=file_name_2, data=addItemToFront)
