# Dynamo graph script.dyn "Place_IntElevAtSelectedRmsOfActiveView" (Dynamo 2.18.1.5096)
# packages: Rhythm 2023.9.1, spring nodes 210.1.1, Clockwork for Dynamo 2.x 2.6.0, Data-Shapes 2023.2.112

# group: WIP
# note: "Work in Progress"

# group: Design
# note: For List Management \ Back-End Functionality

# group: Annotation
# note: For Comments

# group: Info
# note: Good to know stuff

# group: Annotation
# note: For notes and titles

# group: Change / Output
# note: For changes made to Revit or Other App

# group: Control
# note: For sliders and other options

# group: User Input
# note: For selection and whatnot

# group: Background
# note: For workflow

# group: REQUIRED PACKAGES
# note: Rhythm | v.2023.9.1
# spring nodes | v.210.1.1
# Clockwork |  v.2.4.0
# Data-Shapes | v.2023.2.112

# group: REVIT PROJECT REPORT
# note: CREATED BY: Ren Rainville
# CREATED: 08/2019
# VERSION <1.3>
# LAST EDITED: 11/17/2023
# DYNAMO VERSION: <Dynamo 2.18>
# NOTES:
# This tool will place interior elevations at the center of each selected room. (Update: Added feature to set far clip to half room width / height)

# group: User Selection of Rooms in Active View
code_block = CodeBlock { "Select Rooms to Create Interior Elevations at Center (Remember to Click Finish in Top Left)"; }
file_path = Filename("F:\Operations\Marketing\Brand Materials\Logo\GGLO_logo_black.png")
code_block_2 = CodeBlock { "Engage"; "ABORT!"; }
code_block_3 = CodeBlock()
# ---------- code_block_3.designscript (2 lines) ----------
"Tool Tip";
"This Tool allows a user to place interior elevations at the center of each selected room. (Update: Added feature to set far clip to half the room width / height).";
# ----------------------------------------
# note: Custom Node: Data-Shapesv.2023.2.112
ui_textnote_data = Custom[UI.TextNote Data](Title=code_block_3.out0, TextNote=code_block_3.out1)  # package Data-Shapes; Create Data for TextNote input in UI.MultipleInputForm ++ . Check out www.data-shapes.net for more informations
code_block_4 = CodeBlock { "Select Rooms in Active View"; }
code_block_5 = CodeBlock { "OST_Rooms"; }
byName = Category.ByName(name=code_block_5)
ui_selectmodelelements_data = Custom[UI.SelectModelElements Data](InputName=code_block_4, CategoryFilter=byName)  # package Data-Shapes; Creates a Revit element selection input for UI.MultipleInputForm++ . Check out www.data-shapes.net for more infos!
list_create = List.Create(item0=ui_textnote_data, item1=ui_selectmodelelements_data)
boolean = BoolSelector(true)
code_block_6 = CodeBlock { "https://go.gglo.com/Production/SitePages/Dynamo.aspx"; }
ui_multipleinputform = Custom[UI.MultipleInputForm ++](Description_optional=code_block, Logo_optional=file_path, ButtonText_optional=code_block_2.out0, Inputs=list_create, Toggle=boolean, LinkToHelp_optional=code_block_6, CancelButtonText_optional=code_block_2.out1)  # package Data-Shapes; Create a form with multiple inputs. see www.data-shapes.net for tutorials and infos!

# group: Get Room Center Point
geometry = Element.Geometry(element=ui_multipleinputform.User_Inputs)
centroid = Solid.Centroid(solid=geometry)
code_block_7 = CodeBlock(pt=centroid) { pt.X; pt.Y; }
byCoordinates = Point.ByCoordinates(x=code_block_7.out0, y=code_block_7.out1)

# group: Set Elev ViewFamilyType
code_block_8 = CodeBlock { "ViewFamilyType"; }
# note: Custom Node: Clockwork
byName_2 = Custom[ElementType.ByName](name=code_block_8)  # package Clockwork for Dynamo 2.x; Retrieves an element class by its name - to be used with the OOTB node "All Elements of Class".
all_elements_of_type = ElementsOfType(element_type=byName_2)
name = Element.Name(element=all_elements_of_type)
code_block_9 = CodeBlock { "Interior Public Elevation"; }
eq = name == code_block_9
filterByBoolMask = List.FilterByBoolMask(list=all_elements_of_type, mask=eq)

# group: Refresh Toggle
boolean_2 = BoolSelector(true)  # graph input

# group: Set Elevation Marker and which Elevations to Activate
code_block_10 = CodeBlock { 24; 48; 96; }
# note: Custom Node: Rhythmv.2023.9.1
createElevationMarker = Rhythm.Revit.Elements.ElevationMarker.CreateElevationMarker(location=byCoordinates, scaleFactor=code_block_10.out1, viewFamilyType=filterByBoolMask.in)
# note: Custom Node: spring nodesv.210.1.1
activeView = Custom[Springs.Doc.ActiveView](refresh=boolean_2)  # package spring nodes; Selects the current document's active view. Supports more view types than the built-in option. Will be depreciated once the bult in node works with all plan types.
code_block_11 = CodeBlock { 0; 1..3..1; }
addItemToEnd = List.AddItemToEnd(item=code_block_11.out0, list=code_block_11.out1)
createElevationByMarkerIndex = Rhythm.Revit.Elements.ElevationMarker.CreateElevationByMarkerIndex(elevationMarker=createElevationMarker, planView=activeView, index=addItemToEnd)

# group: Create Names for Elevations from Room Names
count = List.Count(list=addItemToEnd)
code_block_12 = CodeBlock(x=count) { 1..x..1; }
code_block_13 = CodeBlock(x=code_block_12) { "_ELEV-"+x; "View Name"; }
# note: Custom Node: Clockwork
name_2 = Custom[Element.Name+](element=ui_multipleinputform.User_Inputs@L2)  # package Clockwork for Dynamo 2.x; Gets an element's name. Unlike the OOTB node, this node should work for *all* Revit elements that have names and will also return the localized names of system parameters, parameter groups, display unit types, parameter types, unit symbol types, unit types and ForgeTypeIds.
ofRepeatedItem = List.OfRepeatedItem(item=name_2, amount=count)
transpose = List.Transpose(lists=ofRepeatedItem)
flatten = List.Flatten(list=code_block_13.out0)
count_2 = List.Count(list=transpose)
ofRepeatedItem_2 = List.OfRepeatedItem(item=flatten, amount=count_2)
code_block_14 = CodeBlock(x=transpose, y=ofRepeatedItem_2) { x+y; }
transpose_2 = List.Transpose(lists=code_block_14@L3)

# group: Set Elev Far Clip and Name per Room Name
setParameterByName = Element.SetParameterByName(element=createElevationByMarkerIndex@L1, parameterName=code_block_13.out1, value=transpose_2@L1)

code_block_15 = CodeBlock(x=createElevationByMarkerIndex) { x[0]; }
