# Dynamo graph script.dyn "Query_FireRating-Doors-n-Host" (Dynamo 2.18.1.5096)
# packages: Clockwork for Dynamo 2.x 2.6.0, WombatDynamo 2.3.5, BumbleBee 2021.25.3

# group: WIP
# note: "Work in Progress"

# group: Design
# note: For List Management \ Back-End Functionality

# group: Annotation
# note: For Comments

# group: Info
# note: Good to know stuff

# group: Annotation
# note: For notes and titles

# group: Change / Output
# note: For changes made to Revit or Other App

# group: Control
# note: For sliders and other options

# group: User Input
# note: For selection and whatnot

# group: Background
# note: For workflow

# group: REQUIRED PACKAGES
# note: Clockwork | v.2.6.0
# WombatDynamo | v.2.3.5
# BumbleBee | v.2021.25.3

# group: REVIT PROJECT REPORT
# note: CREATED BY: Ren Rainville
# CREATED: 09/2019
# VERSION <1.0>
# LAST EDITED: 11/21/2023
# DYNAMO VERSION: <Dynamo 2.18>
# NOTES:
# Output to Excel of doors, their fire rating and the hosts and their fire rating.

# group: User Set Column Headers
code_block = CodeBlock { ["MARK","ELEMENT ID","DOOR RATING","HOST NAME","HOST RATING"]; }

# group: Get All Doors
code_block_2 = CodeBlock { "Doors"; }
byName = Category.ByName(name=code_block_2)
all_elements_of_category = ElementsOfCategory(Category=byName)

# group: User Set Parameters
filter_out_non_08_door_doors = CodeBlock()
# ---------- filter_out_non_08_door_doors.designscript (3 lines) ----------
["DRHW",
"FRM",
"PNL"];
# ----------------------------------------
code_block_3 = CodeBlock { "Host Id"; "Type"; "Mark"; "Fire Rating"; "xxx"; "DOOR FIRE RATING MINUTES"; }

# group: Scrubbing List to Instance Based Doors (DOOR_ : xxx)
# note: Custom Node: Clockwork
host = Custom[Element.Host+](element=all_elements_of_category)  # package Clockwork for Dynamo 2.x; Gets an element's host. Unlike the OOTB node FamilyInstance.GetHost it not only works for family instances but also for elements like wall sweeps, foundations, railings, builing pads and topo subregions.
isNull = Object.IsNull(object=host@L1)
filterByBoolMask = List.FilterByBoolMask(list=all_elements_of_category, mask=isNull)
name = Element.Name(element=filterByBoolMask.out)
startsWith = String.StartsWith(string=name, searchFor=filter_out_non_08_door_doors@L1)
transpose = List.Transpose(lists=startsWith)
anyTrue = Custom[Booleans.AnyTrue](seq=transpose)  # package Clockwork for Dynamo 2.x; Returns true if any item in a list of booleans is true. ATTENTION: This node will be deprecated in 2024. As of Revit 2022, please switch to the OOTB node AnyTrue.
filterByBoolMask_2 = List.FilterByBoolMask(list=filterByBoolMask.out, mask=anyTrue)

# group: Get Door Mark, Element ID, and Fire Rating
getParameterValueByName = Element.GetParameterValueByName(element=filterByBoolMask_2.out, parameterName=code_block_3.out2)
id = Element.Id(element=filterByBoolMask_2.out)
getParameterValueByName_2 = Element.GetParameterValueByName(element=filterByBoolMask_2.out@L1, parameterName=code_block_3.out5)

# group: Get Host Name and Fire Rating (In Minutes)
getParameterValueByName_3 = Element.GetParameterValueByName(element=filterByBoolMask_2.out, parameterName=code_block_3.out0)
# note: Custom Node: WombatDynamov.2.3.5
getType = WombatDynamo.Element.GetType(element=getParameterValueByName_3)
name_2 = Element.Name(element=getType)
getParameterValueByName_4 = Element.GetParameterValueByName(element=getType@L1, parameterName=code_block_3.out3)

# group: Create List for Excel Export
list_create = List.Create(item0=getParameterValueByName, item1=id, item2=getParameterValueByName_2, item3=name_2, item4=getParameterValueByName_4)
transpose_2 = List.Transpose(lists=list_create)
addItemToFront = List.AddItemToFront(item=code_block, list=transpose_2)

# group: Write to Excel
boolean = BoolSelector(true)
boolean_2 = BoolSelector(false)
code_block_4 = CodeBlock { "Sheet1"; "A1"; }
# note: Custom Node: BumbleBeev.2021.25.3
bb_data = Custom[BB Data](sheetName=code_block_4.out0, origin=code_block_4.out1, data=addItemToFront)  # package BumbleBee; This node is a building block for different modes of writing to Excel files. You can combines this node into a list to write to multiple sheets or use just one to write to a single sheet.
write_excel = Custom[Write Excel](runIt=boolean, byColumn=boolean_2, BBData=bb_data)  # package BumbleBee; This node will write data to Excel file and based on how your BBData nodes are structured it will either override the exsting file, create a new one and write a single worksheet or write multiple worksheets.
