# Dynamo graph script.dyn "Sheet_NumberViewsByGrid" (Dynamo 2.18.1.5096)
# packages: spring nodes 210.1.1, archi-lab.net 2024.217.1024, Clockwork for Dynamo 2.x 2.6.0, Rhythm 2023.9.1

# group: WIP
# note: "Work in Progress"

# group: Design
# note: For List Management \ Back-End Functionality

# group: Annotation
# note: For Comments

# group: Info
# note: Good to know stuff

# group: Annotation
# note: For notes and titles

# group: Change / Output
# note: For changes made to Revit or Other App

# group: Control
# note: For sliders and other options

# group: User Input
# note: For selection and whatnot

# group: Background
# note: For workflow

# group: REQUIRED PACKAGES
# note: spring nodes |  v.210.1.1
# archilab |  v.2022.212.3222
# Clockwork |  v.2.4.0
# Rhythm |  v.2021.4.2

# group: REVIT PROJECT REPORT
# note: CREATED BY: Ren Rainville
# CREATED: 8/2019
# VERSION <1.5>
# LAST EDITED: 11/17/2023
# DYNAMO VERSION: <Dynamo 2.18>
# NOTES:
# Team Members need to be very aware of the extents of the viewports, as the lower left corner of viewport will assign the view number by the grid system.

# group: Get Active View and Viewports on that Sheet
# note: Custom Node: spring nodes v.210.1.1
ꟿ_document_activeview = Custom[ꟿ Document.ActiveView]()  # package spring nodes; Selects the current document's active view. Supports more view types than the built-in option. Will be depreciated once the bult in node works with all plan types.
viewports = Sheet.Viewports(sheet=ꟿ_document_activeview)

# group: Viewport Locations on Sheet
# note: Custom Node: Rhythm v.2021.4.2
ʳʰʸᵗʰᵐ_viewport_locationdata = Rhythm.Revit.Elements.Viewport.LocationData(viewport=viewports)
minPoint = BoundingBox.MinPoint(boundingBox=ʳʰʸᵗʰᵐ_viewport_locationdata.bBox)

# group: Check Point Location for Values
code_block = CodeBlock(pt=minPoint) { (pt.X+0.125); }
code_block_2 = CodeBlock(pt=minPoint) { (pt.Y+0.125); }
byCoordinates = Point.ByCoordinates(x=code_block, y=code_block_2)

string = StringInput("""NOTES:
Team Members need to be very aware of the extents of the viewports, as the lower left corner of viewport will assign the view number by the grid system.""")  # graph input

# group: Set Temporary Detail Numbers to Avoid Duplicates
code_block_3 = CodeBlock { "VIEWPORT_DETAIL_NUMBER"; }
# note: Custom Node: archilab v.2022.212.3222
get_built_in_parameter = Custom[Get Built In Parameter](parameterNames=code_block_3, elements=viewports)  # package archi-lab.net; This node will take an input of a built in parameter name and element to return that parameters value.
code_block_4 = CodeBlock { "dup"; }
code_block_5 = CodeBlock(a=get_built_in_parameter, b=code_block_4) { a+b; }
set_builtin_parameter = Custom[Set BuiltIn Parameter](parameterName=code_block_3, elements=viewports, parameterValues=code_block_5)  # package archi-lab.net; This node will take an input of a built in parameter name and set that parameter to given value for given elements.

# note: Custom Node: Clockwork v.2.4.0
passthrough = Custom[Passthrough](passThrough=viewports, waitFor=set_builtin_parameter)  # package Clockwork for Dynamo 2.x; Forces a sequential order of execution. The node wired into the output of the Passthrough node will be executed *after* the node wired into the waitFor input (e.g. important for some Revit operations). The value of the passThrough input will be passed on to the node wired into the output port of the Passthrough node.

# group: Get the Title Block on the Sheet
code_block_6 = CodeBlock { "OST_TitleBlocks"; }
byName = Category.ByName(name=code_block_6)
all_elements_of_category = ElementsOfCategory(Category=byName)
code_block_7 = CodeBlock { "Sheet Number"; }
getParameterValueByName = Element.GetParameterValueByName(element=ꟿ_document_activeview, parameterName=code_block_7)
getParameterValueByName_2 = Element.GetParameterValueByName(element=all_elements_of_category, parameterName=code_block_7)
eq = getParameterValueByName == getParameterValueByName_2
filterByBoolMask = List.FilterByBoolMask(list=all_elements_of_category, mask=eq)

location = FamilyInstance.Location(familyInstance=filterByBoolMask.in)

# group: Get the Sheet's Width and Y Offset from Origin
code_block_8 = CodeBlock { "SHEET_HEIGHT"; }
# note: Custom Node: archilab v.2022.212.3222
get_built_in_parameter_2 = Custom[Get Built In Parameter](parameterNames=code_block_8, elements=filterByBoolMask.in)
code_block_9 = CodeBlock(pt=location) { pt.Y; 304.8; }
code_block_10 = CodeBlock(height=get_built_in_parameter_2, conversion=code_block_9.out1, y=code_block_9.out0) { height*conversion+y; }

# group: Select Margin Dims per Title Block Size
code_block_11 = CodeBlock()
# ---------- code_block_11.designscript (3 lines) ----------
[[98.425,38.1,12.7,12.7],
[95.25,38.1,19.05,12.7],
[95.25,34.925,19.05,19.05]];
# ----------------------------------------
code_block_12 = CodeBlock()
# ---------- code_block_12.designscript (5 lines) ----------
[0,
0,
1,
1,
2];
# ----------------------------------------
name = Element.Name(element=filterByBoolMask.in)
code_block_13 = CodeBlock()
# ---------- code_block_13.designscript (5 lines) ----------
["22x34",
"24x36",
"30x42",
"34x44",
"36x48"];
# ----------------------------------------
contains = String.Contains(string=name, searchFor=code_block_13@L1)
flatten = List.Flatten(list=contains)
code_block_14 = CodeBlock { true; }
indexOf = List.IndexOf(list=flatten@L2, element=code_block_14)
getItemAtIndex = List.GetItemAtIndex(list=code_block_12, index=indexOf)
getItemAtIndex_2 = List.GetItemAtIndex(list=code_block_11, index=getItemAtIndex)
flatten_2 = List.Flatten(list=getItemAtIndex_2)

code_block_15 = CodeBlock(x=flatten_2) { x[0]; x[1]; x[2]; x[3]; }

# group: Top Margin Adjustment
code_block_16 = CodeBlock { 19.05; }
sub = code_block_10 - code_block_15.out2

# group: Bottom Margin Adjustment
code_block_17 = CodeBlock { 12.7; }
add = code_block_9.out0 + code_block_15.out3

# group: Select # of Cells X, Y per TTLB
code_block_18 = CodeBlock { [[4.5,3.5],[5,4],[6,5],[6.33,5.75],[7,6]]; }
getItemAtIndex_3 = List.GetItemAtIndex(list=code_block_18, index=indexOf)
flatten_3 = List.Flatten(list=getItemAtIndex_3)

# group: # of Cells
# note: Grid X [0]
# note: Grid Y [1]
code_block_19 = CodeBlock(x=flatten_3) { x[0]; x[1]; }

# group: Size of Each Grid Cell in Y
sub_2 = sub - add
div = sub_2 / code_block_19.out1

# group: Divide Viewports' Y Value by Cell Size to Identify Location
code_block_20 = CodeBlock(pt=minPoint) { (pt.Y+0.125)*304.8; }
div_2 = code_block_20@L1 / div  # lacing=Longest
code_block_21 = CodeBlock(y=div_2) { y+1; }
floor = Math.Floor(number=code_block_21)
code_block_22 = CodeBlock { true; }
# note: Custom Node: Clockwork v.2.4.0
fromNumber = Custom[Character.FromNumber](n=floor@L1, upperCase=code_block_22)  # package Clockwork for Dynamo 2.x; Converts a number into a character (where 1 = A, 2 = B, ... , 27 = AA, 28 = AB etc.).

# group: Get the Sheet's Width and X Offset from Origin
code_block_23 = CodeBlock { "SHEET_WIDTH"; }
# note: Custom Node: archilab v.2022.212.3222
get_built_in_parameter_3 = Custom[Get Built In Parameter](parameterNames=code_block_23, elements=filterByBoolMask.in)
code_block_24 = CodeBlock(pt=location) { pt.X; 304.8; }
code_block_25 = CodeBlock(width=get_built_in_parameter_3, conversion=code_block_24.out1, x=code_block_24.out0) { width*conversion+x; }

# group: Right Margin Adjustment
code_block_26 = CodeBlock { 95.25; }
sub_3 = code_block_25 - code_block_15.out0

# group: Left Margin Adjustment
code_block_27 = CodeBlock { 38.1; }
add_2 = code_block_24.out0 + code_block_15.out1

# group: Size of Each Grid Cell in X
sub_4 = sub_3 - add_2
div_3 = sub_4 / code_block_19.out0

# group: Divide Viewports' X Value by Cell Size to Identify Location
code_block_28 = CodeBlock(pt=minPoint) { (pt.X+0.125)*304.8; }
div_4 = code_block_28 / div_3  # lacing=Longest
ceiling = Math.Ceiling(number=div_4)

code_block_29 = CodeBlock(a=fromNumber, b=ceiling) { a+b; }
# note: Custom Node: archilab v.2022.212.3222
duplicateItemIndicies = archilab.Lists.Lists.DuplicateItemIndicies(list=code_block_29)

# group: Remove Duplicate Addresses
removeItemAtIndex = List.RemoveItemAtIndex(list=passthrough, indices=duplicateItemIndicies.duplicate)
getItemAtIndex_4 = List.GetItemAtIndex(list=code_block_29, index=duplicateItemIndicies.unique)

# group: Set Detail Numbers
code_block_30 = CodeBlock { "VIEWPORT_DETAIL_NUMBER"; }
# note: Custom Node: archilab v.2022.212.3222
setBuiltInParameter = archilab.Revit.Elements.Parameter.SetBuiltInParameter(element=removeItemAtIndex, bipName=code_block_30, value=getItemAtIndex_4)
