# Dynamo graph script.dyn "Views_DupRenameQuadParentViews" (Dynamo 2.18.1.5096)
# packages: Clockwork for Dynamo 2.x 2.6.0, Data-Shapes 2023.2.112, Ampersand 2022.1.25, archi-lab.net 2024.217.1024

# group: WIP
# note: "Work in Progress"

# group: Design
# note: For List Management \ Back-End Functionality

# group: Annotation
# note: For Comments

# group: Info
# note: Good to know stuff

# group: Annotation
# note: For notes and titles

# group: Change / Output
# note: For changes made to Revit or Other App

# group: Control
# note: For sliders and other options

# group: User Input
# note: For selection and whatnot

# group: Background
# note: For workflow

# group: REQUIRED PACKAGES
# note: Clockwork | v2.4
# designtech | v.1.0.8
# Data-Shapes | v.2022.2.103

# group: REVIT PROJECT REPORT
# note: CREATED BY: Ren Rainville
# CREATED: 05/2023
# VERSION <2.0>
# LAST EDITED: 11/20/2023
# DYNAMO VERSION: <Dynamo 2.18>
# NOTES:
# This tool allows duplicating PARENT views as Dependents while naming them by the Quad Scope Box. It now includes a UI dialog box to ask user to select View Group and then View Sub-Group to select the views duplicate as dependent.

# group: Get All Views
code_block = CodeBlock { "Views"; }
byName = Category.ByName(name=code_block)
all_elements_of_category = ElementsOfCategory(Category=byName)
isNull = Object.IsNull(object=all_elements_of_category)
filterByBoolMask = List.FilterByBoolMask(list=all_elements_of_category, mask=isNull)
isViewTemplate = View.IsViewTemplate(view=filterByBoolMask.out)
filterByBoolMask_2 = List.FilterByBoolMask(list=filterByBoolMask.out, mask=isViewTemplate)

# group: Cull Problem View Types
viewType = archilab.Revit.Views.Views.ViewType(view=filterByBoolMask_2.out)
code_block_2 = CodeBlock()
# ---------- code_block_2.designscript (4 lines) ----------
["Legend",
"Drafting",
"ThreeD",
"Axonometric"];
# ----------------------------------------
contains = String.Contains(string=viewType, searchFor=code_block_2@L2, lacing=CrossProduct)
anyTrue = List.AnyTrue(list=contains@L2)
filterByBoolMask_3 = List.FilterByBoolMask(list=filterByBoolMask_2.out, mask=anyTrue)

# group: Sort by View Group
code_block_3 = CodeBlock { "View Group"; "View Sub-Group"; }
getParameterValueByName = Element.GetParameterValueByName(element=filterByBoolMask_3.out, parameterName=code_block_3.out0)
list_groupbykey = Custom[[&] List.GroupByKey](objectList=filterByBoolMask_3.out, keys=getParameterValueByName)  # package Ampersand; Sort the items of a list into groups (sublists) based on the corresponding items of a reference list. Example: The list {A,B,C,D,E} with the reference list {1,anyWord,4,anyWord,1} will be grouped into lists as { {A,E}, {B,D}, {C} } and the unique references will be {1, anyWord, 4}.

# group: User Input First Dialog
code_block_4 = CodeBlock { "Views - Duplicate Parent Views as Dependent, Name per Scope Box"; }
file_path = Filename("H:\Dynamo\General\GGLO_logo_black.png")
code_block_5 = CodeBlock { "Engage"; "ABORT!"; 600; 600; 300; }
code_block_6 = CodeBlock()
# ---------- code_block_6.designscript (2 lines) ----------
"Tool Tip";
"This Tool will ask the users for a suffix of a view to duplicate, it will duplicate the Parent view as dependent, remove ' - PARENT - Copy #' from the name and append the scope box name. Scope boxes for this process should include QUAD.";
# ----------------------------------------
# note: Custom Node: Data-Shapesv.2022.2.103
ui_textnote_data = Custom[UI.TextNote Data](Title=code_block_6.out0, TextNote=code_block_6.out1)  # package Data-Shapes; Create Data for TextNote input in UI.MultipleInputForm ++ . Check out www.data-shapes.net for more informations
code_block_7 = CodeBlock { "Select View Group"; }
count = List.Count(list=list_groupbykey.unique_keys)
code_block_8 = CodeBlock(x=count) { 0..x-1..1; }
dropdown_data = Custom[DropDown Data](InputName=code_block_7, Keys=list_groupbykey.unique_keys, Values=code_block_8)  # package Data-Shapes; Create data for DropDown input in UI.MultiInputForm ++ . Check out www.data-shapes.net for more infos.
list_create = List.Create(item0=ui_textnote_data, item1=dropdown_data)
code_block_9 = CodeBlock { 2; }
flatten = List.Flatten(list=list_create, amount=code_block_9)
boolean = BoolSelector(true)
code_block_10 = CodeBlock { "https://go.gglo.com/page/90/design-computation-toolbox"; }
ui_multipleinputform = Custom[UI.MultipleInputForm ++](Description_optional=code_block_4, Logo_optional=file_path, ButtonText_optional=code_block_5.out0, Inputs=flatten, Toggle=boolean, LinkToHelp_optional=code_block_10, CancelButtonText_optional=code_block_5.out1, MaxHeight_optional=code_block_5.out2, Width_optional=code_block_5.out3, LabelWidth_optional=code_block_5.out4)  # package Data-Shapes; Create a form with multiple inputs. see www.data-shapes.net for tutorials and infos!
code_block_11 = CodeBlock(x=ui_multipleinputform.User_Inputs) { x[0]; }
code_block_12 = CodeBlock { "Enter Keyword to Search Group Names for Selection:"; "Search String"; false; }
ui_textbox_data = Custom[UI.TextBox Data](InputName=code_block_12.out0, DefaultText=code_block_12.out1, IsNumberEntry=code_block_12.out2)  # package Data-Shapes; Create Data for TextBox input in UI.MultipleInputForm ++ . Check out www.data-shapes.net for more informations
code_block_13 = CodeBlock(x=list_groupbykey.unique_keys) { x; }

# group: Sort by View Sub-Group
transpose = List.Transpose(lists=list_groupbykey.groups@L2)
getItemAtIndex = List.GetItemAtIndex(list=transpose@L3, index=code_block_11)
getParameterValueByName_2 = Element.GetParameterValueByName(element=getItemAtIndex, parameterName=code_block_3.out1)
list_groupbykey_2 = Custom[[&] List.GroupByKey](objectList=getItemAtIndex@L2, keys=getParameterValueByName_2@L2)

transpose_2 = List.Transpose(lists=list_groupbykey_2.groups)

# group: User Input First Dialog
code_block_14 = CodeBlock { "Views - Duplicate Parent Views as Dependent, Name per Scope Box"; }
code_block_15 = CodeBlock { "Engage"; "ABORT!"; 600; 600; 300; }
code_block_16 = CodeBlock { "Tool Tip"; "Once View Group is Selected, Choose a View Sub-Group"; }
# note: Custom Node: Data-Shapesv.2022.2.103
ui_textnote_data_2 = Custom[UI.TextNote Data](Title=code_block_16.out0, TextNote=code_block_16.out1)
code_block_17 = CodeBlock { "Select View Sub-Group"; }
flatten_2 = List.Flatten(list=list_groupbykey_2.unique_keys)
count_2 = List.Count(list=flatten_2)
code_block_18 = CodeBlock(x=count_2) { 0..x-1..1; }
dropdown_data_2 = Custom[DropDown Data](InputName=code_block_17, Keys=list_groupbykey_2.unique_keys, Values=code_block_18)
list_create_2 = List.Create(item0=ui_textnote_data_2, item1=dropdown_data_2)
flatten_3 = List.Flatten(list=list_create_2)
boolean_2 = BoolSelector(true)
passthrough = Custom[Passthrough](passThrough=boolean_2, waitFor=code_block_11)  # package Clockwork for Dynamo 2.x; Forces a sequential order of execution. The node wired into the output of the Passthrough node will be executed *after* the node wired into the waitFor input (e.g. important for some Revit operations). The value of the passThrough input will be passed on to the node wired into the output port of the Passthrough node.
ui_multipleinputform_2 = Custom[UI.MultipleInputForm ++](Description_optional=code_block_14, Logo_optional=file_path, ButtonText_optional=code_block_15.out0, Inputs=flatten_3, Toggle=passthrough, LinkToHelp_optional=code_block_10, CancelButtonText_optional=code_block_15.out1, MaxHeight_optional=code_block_15.out2, Width_optional=code_block_15.out3, LabelWidth_optional=code_block_15.out4)
code_block_19 = CodeBlock(x=ui_multipleinputform_2.User_Inputs) { x[0]; }

getItemAtIndex_2 = List.GetItemAtIndex(list=transpose_2, index=code_block_19)
code_block_20 = CodeBlock(x=getItemAtIndex_2) { x; }

# group: Gather Scope Boxes that Contain 'QUAD' in the Name
code_block_21 = CodeBlock { "Scope Boxes"; }
byName_2 = Category.ByName(name=code_block_21)
all_elements_of_category_2 = ElementsOfCategory(Category=byName_2)
code_block_22 = CodeBlock(s=all_elements_of_category_2) { s.Name; }
code_block_23 = CodeBlock { "QUAD"; "QUADRANT"; }
contains_2 = String.Contains(string=code_block_22, searchFor=code_block_23.out0)
contains_3 = String.Contains(string=code_block_22, searchFor=code_block_23.out1)
or_ = contains_2 || contains_3
filterByBoolMask_4 = List.FilterByBoolMask(list=all_elements_of_category_2, mask=or_)
count_3 = List.Count(list=filterByBoolMask_4.in)

# group: (Step #2) Remove any characters after " - " such as PARENT
code_block_24 = CodeBlock(v=getItemAtIndex_2) { v.Name; }
code_block_25 = CodeBlock { " - "; }
split = String.Split(string=code_block_24, separator0=code_block_25)
code_block_26 = CodeBlock { 0; }
getItemAtIndex_3 = List.GetItemAtIndex(list=split@L2, index=code_block_26)

# group: Remove any characters before QUAD
code_block_27 = CodeBlock(e=filterByBoolMask_4.in) { e.Name; }
code_block_28 = CodeBlock { " - "; true; 0; }
insert = String.Insert(string=code_block_27, index=code_block_28.out2, toInsert=code_block_28.out0)

# group: Aligning Lists
count_4 = List.Count(list=code_block_27)
ofRepeatedItem = List.OfRepeatedItem(item=getItemAtIndex_3, amount=count_4)
transpose_3 = List.Transpose(lists=ofRepeatedItem)
flatten_4 = List.Flatten(list=transpose_3)
count_5 = List.Count(list=getItemAtIndex_3)
ofRepeatedItem_2 = List.OfRepeatedItem(item=insert, amount=count_5)
flatten_5 = List.Flatten(list=ofRepeatedItem_2)

# group: Sets View Name Per Standard
list_create_3 = List.Create(item0=flatten_4, item1=flatten_5)
transpose_4 = List.Transpose(lists=list_create_3)
concat = String.Concat(string0=transpose_4@L2)
chop = List.Chop(list=concat, lengths=count_4)
transpose_5 = List.Transpose(lists=chop)

flatten_6 = List.Flatten(list=transpose_5)

# group: (STEP #1) Duplicate Parent per # of Quads
ofRepeatedItem_3 = List.OfRepeatedItem(item=code_block_20, amount=count_3)
transpose_6 = List.Transpose(lists=ofRepeatedItem_3@L3)
flatten_7 = List.Flatten(list=transpose_6)
# note: Custom Node: Clockwork
duplicateAsDependent = Custom[View.DuplicateAsDependent](view=flatten_7, name=flatten_6)  # package Clockwork for Dynamo 2.x; Duplicates a given view as a dependent view

# group: Group Sector Plans by Sector
flatten_8 = List.Flatten(list=duplicateAsDependent)
code_block_29 = CodeBlock(v=duplicateAsDependent) { v.Name; }
code_block_30 = CodeBlock { -1; 1; }
substring = String.Substring(string=code_block_29, startIndex=code_block_30.out0, length=code_block_30.out1)
groupByKey = List.GroupByKey(list=flatten_8, keys=substring)

# group: Set Scope Box to Views
code_block_31 = CodeBlock { "Scope Box"; }
count_6 = List.Count(list=groupByKey.groups@L2)
ofRepeatedItem_4 = List.OfRepeatedItem(item=filterByBoolMask_4.in@L1, amount=count_6@L1)
setParameterByName = Element.SetParameterByName(element=groupByKey.groups, parameterName=code_block_31, value=ofRepeatedItem_4)

code_block_32 = CodeBlock(x=code_block_11) { x; }
code_block_33 = CodeBlock(x=list_groupbykey.unique_keys) { x; }
code_block_34 = CodeBlock { x; }  # unwired: x
code_block_35 = CodeBlock(x=filterByBoolMask_3.out) { x; }
code_block_36 = CodeBlock(x=filterByBoolMask_2.out) { x; }
code_block_37 = CodeBlock(x=flatten_2) { x; }
