# Dynamo graph script.dyn "Views_UNIT_AreGroupsDuplicated" (Dynamo 2.18.1.5096)
# packages: Data-Shapes 2023.2.112, BumbleBee 2021.25.3, Clockwork for Dynamo 2.x 2.6.0

# group: WIP
# note: "Work in Progress"

# group: Design
# note: For List Management \ Back-End Functionality

# group: Annotation
# note: For Comments

# group: Info
# note: Good to know stuff

# group: Annotation
# note: For notes and titles

# group: Change / Output
# note: For changes made to Revit or Other App

# group: Control
# note: For sliders and other options

# group: User Input
# note: For selection and whatnot

# group: Background
# note: For workflow

# group: REQUIRED PACKAGES
# note: Data-Shapes | v.2023.2.112
# BumbleBee | v.2021.25.3
# Clockwork | v2.6.0

# group: REVIT PROJECT REPORT
# note: CREATED BY: Ren Rainville
# CREATED: 06/2021
# VERSION <1.0>
# LAST EDITED: 11/21/2023
# DYNAMO VERSION: <Dynamo 2.18>
# NOTES:
# This tool allows a user to check if there are duplicate instances of a groups at SEA LEVEL prior to running the UNIT AreaPlan and 3D View creation tool.

# group: Get All Model Groups
python_script = Python()  # IronPython2
# ---------- python_script.python (35 lines) ----------
#Copyright(c) 2015, Konrad Sobon
# @arch_laboratory, http://archi-lab.net

import clr
clr.AddReference('ProtoGeometry')
from Autodesk.DesignScript.Geometry import *

# Import DocumentManager and TransactionManager
clr.AddReference("RevitServices")
import RevitServices
from RevitServices.Persistence import DocumentManager
from RevitServices.Transactions import TransactionManager

# Import RevitAPI
clr.AddReference("RevitAPI")
import Autodesk
from Autodesk.Revit.DB import *

doc = DocumentManager.Instance.CurrentDBDocument
uiapp = DocumentManager.Instance.CurrentUIApplication
app = uiapp.Application

from System.Collections.Generic import *

#The inputs to this node will be stored as a list in the IN variable.
dataEnteringNode = IN

collector = FilteredElementCollector(doc)
groups = collector.OfCategory(BuiltInCategory.OST_IOSModelGroups).WhereElementIsNotElementType().ToElements()

groupNames = []
for i in groups:
	groupNames.append(i.Name)

OUT = groupNames, groups
# ----------------------------------------
code_block = CodeBlock(OUT=python_script) { OUT[0]; OUT[1]; }
code_block_2 = CodeBlock(Groups=code_block.out1) { Groups; }

# group: LEVEL to Select
code_block_3 = CodeBlock { "SEA LEVEL"; }

# group: Select Only Specific Level Model Groups
# note: Custom Node: Clockwork
level = Custom[Element.Level](element=code_block_2)  # package Clockwork for Dynamo 2.x; Gets an element's level
groupByKey = List.GroupByKey(list=code_block_2, keys=level)
name = Element.Name(element=groupByKey.uniqueKeys)
startsWith = String.StartsWith(string=name, searchFor=code_block_3)
filterByBoolMask = List.FilterByBoolMask(list=groupByKey.groups, mask=startsWith)
flatten = List.Flatten(list=filterByBoolMask.in)

# group: User Dialog showing duplicate groups, offer export to excel
code_block_4 = CodeBlock { "Check Groups @ SEA LEVEL for Duplicate Names / Instances:"; }
file_path = Filename("H:\Dynamo\General\GGLO_logo_black.png")
code_block_5 = CodeBlock { "Engage"; "ABORT!"; }
code_block_6 = CodeBlock { "Input Keyword for Group Selection @ SEA LEVEL"; }
# note: Custom Node: Data-Shapesv.2023.2.112
ui_textbox_data = Custom[UI.TextBox Data](InputName=code_block_6)  # package Data-Shapes; Create Data for TextBox input in UI.MultipleInputForm ++ . Check out www.data-shapes.net for more informations
flatten_2 = List.Flatten(list=ui_textbox_data)
list_create = List.Create(item0=flatten_2)
boolean = BoolSelector(true)
code_block_7 = CodeBlock { "https://go.gglo.com/Production/SitePages/Dynamo.aspx"; }
ui_multipleinputform = Custom[UI.MultipleInputForm ++](Description_optional=code_block_4, Logo_optional=file_path, ButtonText_optional=code_block_5.out0, Inputs=list_create, Toggle=boolean, LinkToHelp_optional=code_block_7, CancelButtonText_optional=code_block_5.out1)  # package Data-Shapes; Create a form with multiple inputs. see www.data-shapes.net for tutorials and infos!

code_block_8 = CodeBlock(x=ui_multipleinputform.User_Inputs) { x[0]; }

# group: Get Only Groups w/ User Supplied Keyword
name_2 = Element.Name(element=flatten)
contains = String.Contains(string=name_2@L1, searchFor=code_block_8)
flatten_3 = List.Flatten(list=contains)
filterByBoolMask_2 = List.FilterByBoolMask(list=flatten, mask=flatten_3)

name_3 = Element.Name(element=filterByBoolMask_2.in)
uniqueItems = List.UniqueItems(list=name_3)

# group: Find Occurances Greater Than 1
# note: Custom Node: Clockwork
countOccurences = Custom[List.CountOccurences](seq=name_3)  # package Clockwork for Dynamo 2.x; Counts the number of occurences of each unique element in a given list
code_block_9 = CodeBlock { 1; }
gt = countOccurences.count > code_block_9
filterByBoolMask_3 = List.FilterByBoolMask(list=countOccurences.uniqueElements, mask=gt)
anyTrue = List.AnyTrue(list=gt)

contains_2 = String.Contains(string=name_3, searchFor=filterByBoolMask_3.in@L1)
code_block_10 = CodeBlock { true; }
allIndicesOf = List.AllIndicesOf(list=contains_2@L2, item=code_block_10)
getItemAtIndex = List.GetItemAtIndex(list=filterByBoolMask_2.in, index=allIndicesOf)

# group: Organize Group Name and Element Id for Presentation to User and Export to Excel
code_block_11 = CodeBlock { ["Group Name", "Element ID"]; }
name_4 = Element.Name(element=getItemAtIndex)
id = Element.Id(element=getItemAtIndex)
list_create_2 = List.Create(item0=name_4, item1=id)
code_block_12 = CodeBlock { 1; }
flatten_4 = List.Flatten(list=list_create_2@L3, amount=code_block_12)
transpose = List.Transpose(lists=flatten_4)
addItemToFront = List.AddItemToFront(item=code_block_11, list=transpose)

# group: Concatinate the Data for Presentation
string_from_object = FromObject(obj=addItemToFront)
code_block_13 = CodeBlock { " - "; }
count = List.Count(list=string_from_object)
ofRepeatedItem = List.OfRepeatedItem(item=code_block_13, amount=count)
code_block_14 = CodeBlock { 1; }
insert = List.Insert(list=string_from_object@L2, element=ofRepeatedItem@L1, index=code_block_14)
concat = String.Concat(string0=insert)

# group: User Dialog showing duplicate groups, offer export to excel
code_block_15 = CodeBlock { "These SEA LEVEL hosted Groups have Duplicate Names:"; }
file_path_2 = Filename("H:\Dynamo\General\GGLO_logo_black.png")
code_block_16 = CodeBlock { "Engage"; "ABORT!"; }
code_block_17 = CodeBlock { "Group Names and Element IDs"; }
# note: Custom Node: Data-Shapesv.2023.2.112
ui_textnote_data = Custom[UI.TextNote Data](Title=code_block_17, TextNote=concat@L2)  # package Data-Shapes; Create Data for TextNote input in UI.MultipleInputForm ++ . Check out www.data-shapes.net for more informations
flatten_5 = List.Flatten(list=ui_textnote_data)
code_block_18 = CodeBlock { "Export to Excel?   saved location: MyDocuments"; }
ui_boolean_input = Custom[UI.Boolean input](InputName=code_block_18)  # package Data-Shapes; Creates a boolean input for UI.MultipleInputForm ++ . Check out www.data-shapes.net for more infos!
list_create_3 = List.Create(item0=flatten_5, item1=ui_boolean_input)
flatten_6 = List.Flatten(list=list_create_3)
code_block_19 = CodeBlock(passthrough=anyTrue, waitfor=concat) { [passthrough,waitfor][0]; }
code_block_20 = CodeBlock { "https://go.gglo.com/Production/SitePages/Dynamo.aspx"; }
ui_multipleinputform_2 = Custom[UI.MultipleInputForm ++](Description_optional=code_block_15, Logo_optional=file_path_2, ButtonText_optional=code_block_16.out0, Inputs=flatten_6, Toggle=code_block_19, LinkToHelp_optional=code_block_20, CancelButtonText_optional=code_block_16.out1)
code_block_21 = CodeBlock { "Click to Close"; }
code_block_22 = CodeBlock { "Are Groups Duplicated?"; "No, there are not any duplicated groups! Congrats. Carry on."; }
ui_textnote_data_2 = Custom[UI.TextNote Data](Title=code_block_22.out0, TextNote=code_block_22.out1)
list_create_4 = List.Create(item0=ui_textnote_data_2)
code_block_23 = CodeBlock { false; true; }
if_ = RefactoredIf(test=anyTrue, true=code_block_23.out0, false=code_block_23.out1)
ui_multipleinputform_3 = Custom[UI.MultipleInputForm ++](Description_optional=code_block_15, Logo_optional=file_path_2, ButtonText_optional=code_block_21, Inputs=list_create_4, Toggle=if_, LinkToHelp_optional=code_block_20)

# group: Export Excel if Users Chooses
code_block_24 = CodeBlock { "DuplicateGroupNames.xlsx"; }
code_block_25 = CodeBlock { "Sheet1"; "B2"; }
# note: Custom Node: BumbleBeev.2021.25.3
bb_data = Custom[BB Data](sheetName=code_block_25.out0, origin=code_block_25.out1, data=addItemToFront)  # package BumbleBee; This node is a building block for different modes of writing to Excel files. You can combines this node into a list to write to multiple sheets or use just one to write to a single sheet.
write_excel = Custom[Write Excel](filePath=code_block_24, runIt=ui_multipleinputform_2.User_Inputs, BBData=bb_data)  # package BumbleBee; This node will write data to Excel file and based on how your BBData nodes are structured it will either override the exsting file, create a new one and write a single worksheet or write multiple worksheets.

# group: Dynamo Player Output
list_create_5 = List.Create(item0=ui_multipleinputform_2.Was_Run, item1=ui_multipleinputform_3.Was_Run)
anyTrue_2 = List.AnyTrue(list=list_create_5)
code_block_26 = CodeBlock { "Success!"; "Uh oh, something went wrong."; }
if_2 = RefactoredIf(test=anyTrue_2, true=code_block_26.out0, false=code_block_26.out1)
player_output = Watch(if_2)  # graph output
