# Dynamo graph RoomTypes_script.dyn (Dynamo 2.17.0.3472)
# packages: archi-lab.net 2023.213.1722, spring nodes 210.1.1

views = Views("Room Style Schedule")
file_path = Filename("C:\_GGLO\RevitTools\GGLO-Toolbar.extension\gglo.tab\Rooms.panel\OmniClass13.urlbutton\OmniClass13.xlsx")
string = StringInput("Sheet1")
openXMLImportExcel = Data.OpenXMLImportExcel(filePath=file_path, sheetName=string)
code_block = CodeBlock { 10; }
takeItems = List.TakeItems(list=openXMLImportExcel@L2, amount=code_block)
code_block_2 = CodeBlock { [2,4,6,8]; }
getItemAtIndex = List.GetItemAtIndex(list=takeItems@L2, index=code_block_2)
restOfItems = List.RestOfItems(list=getItemAtIndex)
clean = List.Clean(list=restOfItems)
lastItem = List.LastItem(list=clean@L2)
code_block_3 = CodeBlock { [3,5,7,9]; }
getItemAtIndex_2 = List.GetItemAtIndex(list=takeItems@L2, index=code_block_3)
restOfItems_2 = List.RestOfItems(list=getItemAtIndex_2)
clean_2 = List.Clean(list=restOfItems_2)
firstItem = List.FirstItem(list=clean_2@L2)
lastItem_2 = List.LastItem(list=clean_2@L2)
list_create = List.Create(item0=lastItem, item1=firstItem, item2=lastItem_2)
transpose = List.Transpose(lists=list_create)
code_block_4 = CodeBlock { ["number", "title", "Name"]; }
key_schedule = Custom[Key Schedule](viewSchedule=views, data=transpose, parameterNames=code_block_4)  # package archi-lab.net; This node will take a key schedule, data and a list of parameters and populate it with infomation from data parameter. Visit www.archi-lab.net for more information on how to prep this node for take off.
ꟿ_list_dropfirstlast = Custom[ꟿ List.DropFirstLast](list=clean_2@L2)  # package spring nodes; Removes the first and last items from the list
code_block_5 = CodeBlock(x=firstItem, y=ꟿ_list_dropfirstlast.rest) { x + "_" + y; }
